# Grasshopper definition objects.gh (Grasshopper 1.0.7)
# plug-ins: DigitalCircularityToolkit

mesh = Mesh([<mesh referenced from the Rhino model> x65])
item = ListItem(List=mesh, Index=Slider(18, range=0..64), Wrap=True)
sphereobj = SphericalObject(Geometry=item, NumSamples=50, Quantity=1, RadiusBuffer=1)  # -> Object, EffectiveSphere
sphereset = SphereSet(SphereObjs=sphereobj.Object)  # -> EffectiveSphere, Plane, EffectiveRadius, Indexer, Objects, Centroids, Hulls
objprops = ObjectProperties(Object=sphereobj.Object)  # -> Centroid, PCA1, PCA2, PCA3, Length, Width, Height, BoundingBox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
lineobj = LinearObject(Geometry=item, NumSamples=50, Quantity=1, LengthBuffer=1, Area=-1)  # -> Object, EffectiveLine
planeobj = PlanarObject(Geometry=item, NumSamples=50, Quantity=1, LengthBuffer=1, WidthBuffer=1, Thickness=-1)  # -> Object, EffectivePlane
boxobj = BoxObject(Geometry=item, NumSamples=50, Quantity=1, LengthBuffer=1, WidthBuffer=1, HeightBuffer=1)  # -> Object, EffectiveBox
number_slider = Slider(12, range=10..20)
edges = BrepEdges(Brep=boxobj.EffectiveBox)  # -> Naked, Interior, NonManifold
msphere = MeshSphere(Base=objprops.LocalPlane, Radius=sphereset.EffectiveRadius, UCount=number_slider, VCount=number_slider)
pl = ConstructPlane(Origin=objprops.Centroid, XAxis=Vector(1, 0, 0), YAxis=Vector(0, 1, 0))
medges = MeshEdges(Mesh=msphere)  # -> NakedEdges, InteriorEdges, NonManifoldEdges
neg = Negative(Value=Slider(1882, range=0..4000))
line = LineSDL(Start=objprops.Centroid, Direction=objprops.PCA2, Length=Slider(1301, range=0..2000))
Z = UnitZ(Factor=neg)
move = Move(Geometry=pl, Motion=Z)  # -> Geometry, Transform
line_2 = LineSDL(Start=objprops.Centroid, Direction=objprops.PCA1, Length=Slider(1513, range=0..2000))
number_slider_2 = Slider(2179, range=1000..3000)
end = EndPoints(Curve=line)  # -> Start, End
end_2 = EndPoints(Curve=line_2)  # -> Start, End
pl_2 = ConstructPlane(Origin=end.End, XAxis=objprops.PCA3, YAxis=objprops.PCA1)
pl_3 = ConstructPlane(Origin=end_2.End, XAxis=objprops.PCA2, YAxis=objprops.PCA3)
number_slider_3 = Slider(30, range=0..100)
planesrf = PlaneSurface(Plane=move.Geometry, XSize=number_slider_2, YSize=number_slider_2)
multiplication = Multiplication(A=number_slider_3, B=Slider(2.15, range=1.5..3))
number_slider_4 = Slider(100, range=100..200)
multiplication_2 = Multiplication(A=multiplication, B=Slider(5, range=2..5))
pipe = Pipe(Curve=line_2, Radius=number_slider_3, Caps=0)
cone = Cone(Base=pl_3, Radius=multiplication, Length=multiplication_2)  # -> Cone, Tip
pipe_2 = Pipe(Curve=line, Radius=number_slider_3, Caps=0)
cone_2 = Cone(Base=pl_2, Radius=multiplication, Length=multiplication_2)  # -> Cone, Tip
sph = Sphere(Base=objprops.Centroid, Radius=Slider(62, range=0..100))
