# Grasshopper definition script.gh (Grasshopper 1.0.7)
# plug-ins: FDMremote, DigitalCircularityToolkit, Human

pipeline = GeometryPipeline(
    GroupByLayer=False,
    GroupByType=False,
    IncludeHidden=True,
    IncludeLocked=True,
    LayerFilter="*Network",
    NameFilter="*",
    SublayerFiltering=True,
    TypeFilter=4)  # disabled
pipeline_2 = GeometryPipeline(
    GroupByLayer=False,
    GroupByType=False,
    IncludeHidden=True,
    IncludeLocked=True,
    LayerFilter="*Network",
    NameFilter="*",
    SublayerFiltering=True,
    TypeFilter=1)  # disabled
number_slider = Slider(-4.8, range=-50..-0.5)  # disabled
number_slider_2 = Slider(20000, range=1000..20000)  # disabled
create = CreateNetwork(Edges=pipeline, Anchors=pipeline_2, ForceDensities=number_slider, IntersectionTolerance=0.1)  # disabled
Z = UnitZ(Factor=number_slider_2)  # disabled
id = Guid(pipeline)  # disabled
neg = Negative(Value=Z)  # disabled
button = Button()  # disabled
analyzesimple = AnalyzeSimpleNetwork(FDMNetwork=create, LoadVector=neg)  # disabled
update = UpdateCurves(UpdateCurves=button, TargetNetwork=analyzesimple, EdgeGUIDs=id)  # disabled
info = NetworkInformation(FDMNetwork=analyzesimple)  # -> Nodes, Edges, EdgeLengths, StartIndex, EndIndex, Anchors, ForceDensities, NumberEdges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; disabled
number_slider_3 = Slider(0, range=0..100)  # disabled
visualize = VisualizeNetwork(
    Show=True,
    Network=analyzesimple,
    Loads=Vector(0, 0, 0),
    LoadScale=100,
    ColourMin=RGB(255, 123, 172),
    ColourMed=RGB(230, 231, 232),
    ColourMax=RGB(62, 168, 222),
    ColorProperty=0,
    LineThickness=number_slider_3,
    LoadColour=RGBA(235, 52, 73, 150),
    ShowLoads=True,
    ReactionColour=RGB(71, 181, 116),
    ShowReactions=True)  # disabled
number_slider_4 = Slider(17, range=0..1000)  # disabled
mesh = Mesh([<mesh referenced from the Rhino model> x65])
brep = Brep([<brep referenced from the Rhino model> x162])  # disabled
division = Division(A=info.MemberForces, B=number_slider_4)  # disabled
boxobj = BoxObject(Geometry=mesh, NumSamples=50, Quantity=1, LengthBuffer=1, WidthBuffer=1, HeightBuffer=1)  # -> Object, EffectiveBox
swatch = ColourSwatch(SwatchColor=RGBA(255, 255, 255, 118))  # disabled
abs = Absolute(Value=division)  # -> flatten(Result); disabled
panel = Panel(abs)  # disabled
lineobj = LinearObject(Geometry=info.Edges, NumSamples=50, Quantity=1, LengthBuffer=1, Area=abs)  # -> Object, EffectiveLine; disabled
lineobj_2 = LinearObject(Geometry=brep, NumSamples=50, Quantity=1, LengthBuffer=1, Area=-1)  # -> Object, EffectiveLine; disabled
preview = CustomPreview(Geometry=brep, Material=swatch)  # disabled
planaroutline = PlanarOutline(Object=boxobj.Object)
number_slider_5 = Slider(30, range=10..30)
linearset = LinearSet(LinearObjs=lineobj.Object)  # -> EffectiveLine, EffectiveLength, Area, CentroidPlane, Indexer, Objects, Centroids, Hulls; disabled
linearset_2 = LinearSet(LinearObjs=lineobj_2.Object)  # -> EffectiveLine, EffectiveLength, Area, CentroidPlane, Indexer, Objects, Centroids, Hulls; disabled
radialsig = RadialSignature(Curve=planaroutline, NumSamples=number_slider_5)  # -> ComplexSignature, DistanceSignature, ProjectedCurve, Rays
featurevec = FeatureVector(X1=linearset_2.EffectiveLength, X2=linearset_2.Area)  # disabled
featurevec_2 = FeatureVector(X1=linearset.EffectiveLength, X2=linearset.Area)  # disabled
crv = Curve(<curve referenced from the Rhino model>)
previewlw = CustomPreviewLineweights(
    Geometry=[radialsig.ProjectedCurve, radialsig.Rays],
    Shader=ColourSwatch(SwatchColor=RGB(255, 255, 255)),
    Thickness=Slider(1, range=1..4),
    Absolute=False)
boxset = BoxSet(Objects=boxobj.Object)  # -> EffectiveBox, Plane, EffectiveLength, EffectiveWidth, EffectiveHeight, Indexer, Objects, Centroids, Hulls
pop2d = Populate2D(Region=crv, Count=Slider(50, range=20..50), Seed=Slider(21, range=0..50))
graph = QuickGraph(radialsig.DistanceSignature, SortOrder=0)
dmeuclidean = EuclideanDistance(FVdemand=featurevec_2, FVsupply=featurevec, Power=1)  # disabled
voronoi = Voronoi(Points=pop2d, Boundary=crv, BruteForceOverride=False)
hungarian = Hungarian(DistanceMatrix=dmeuclidean)  # -> Assignment, Cost; disabled
radialsig_2 = RadialSignature(Curve=voronoi, NumSamples=number_slider_5)  # -> ComplexSignature, DistanceSignature, ProjectedCurve, Rays
item = ListItem(List=brep, Index=hungarian.Assignment, Wrap=True)  # disabled
previewlw_2 = CustomPreviewLineweights(
    Geometry=[voronoi, crv],
    Shader=ColourSwatch(SwatchColor=RGB(69, 69, 69)),
    Thickness=Slider(3, range=1..4),
    Absolute=False)
item_2 = ListItem(List=lineobj_2.Object, Index=hungarian.Assignment, Wrap=True)  # disabled
edges = BrepEdges(Brep=item)  # -> Naked, Interior, NonManifold; disabled
number_slider_6 = Slider(2, range=1..4)  # disabled
graph_2 = QuickGraph(radialsig_2.DistanceSignature, SortOrder=0)
matchlines = MatchLines(DemandPoints=linearset.Centroids, SupplyPoints=linearset_2.Centroids, AssignmentIndices=hungarian.Assignment)  # disabled
alignobj = AlignToObject(SourceObject=item_2, TargetObject=lineobj.Object)  # -> Object, Geometry, Transform; disabled
swatch_2 = ColourSwatch(SwatchColor=RGB(3, 162, 255))  # disabled
number_slider_7 = Slider(1, range=1..4)  # disabled
harmonicscomplex = HarmonicAnalysisComplex(ComplexSig=radialsig.ComplexSignature)
harmonicscomplex_2 = HarmonicAnalysisComplex(ComplexSig=radialsig_2.ComplexSignature)
swatch_3 = ColourSwatch(SwatchColor=RGBA(28, 172, 255, 190))  # disabled
swatch_4 = ColourSwatch(SwatchColor=RGB(153, 218, 255))  # disabled
previewlw_3 = CustomPreviewLineweights(Geometry=edges.Interior, Shader=swatch_2, Thickness=number_slider_6, Absolute=False)  # disabled
planeobj = PlanarObject(Geometry=voronoi, NumSamples=50, Quantity=1, LengthBuffer=1, WidthBuffer=1, Thickness=-1)  # -> Object, EffectivePlane
preview_2 = CustomPreview(Geometry=alignobj.Geometry, Material=swatch_3)  # disabled
previewlw_4 = CustomPreviewLineweights(Geometry=matchlines, Shader=swatch_4, Thickness=number_slider_7, Absolute=False)  # disabled
dmeuclidean_2 = EuclideanDistance(FVdemand=harmonicscomplex_2, FVsupply=harmonicscomplex, Power=1)
planarset = PlanarSet(PlanarObjs=planeobj.Object)  # -> EffectivePlane, Plane, EffectiveLength, EffectiveWidth, Thickness, Indexer, Objects, Centroids, Hulls
hungarian_2 = Hungarian(DistanceMatrix=dmeuclidean_2)  # -> Assignment, Cost
item_3 = ListItem(List=boxobj.Object, Index=hungarian_2.Assignment, Wrap=True)
boxset_2 = BoxSet(Objects=item_3)  # -> EffectiveBox, Plane, EffectiveLength, EffectiveWidth, EffectiveHeight, Indexer, Objects, Centroids, Hulls
alignobj_2 = AlignToObject(SourceObject=item_3, TargetObject=planeobj.Object)  # -> Object, Geometry, Transform
edges_2 = BrepEdges(Brep=boxset_2.EffectiveBox)  # -> Naked, Interior, NonManifold
previewlw_5 = CustomPreviewLineweights(
    Geometry=edges_2.Interior,
    Shader=ColourSwatch(SwatchColor=RGB(3, 162, 255)),
    Thickness=Slider(2, range=1..4),
    Absolute=False)
knoll = Knoll(
    Objects=alignobj_2.Object,
    OriginPlane=Plane(origin=(0, 0, 0), x=(0, 1, 0), y=(1, 0, 0)),
    NumRows="4",
    RowSpacing=Slider(500, range=0..1000),
    ColSpacing=Slider(500, range=0..1000))  # -> Objects, Geo
matchlines_2 = MatchLines(DemandPoints=planarset.Centroids, SupplyPoints=boxset.Centroids, AssignmentIndices=hungarian_2.Assignment)
preview_3 = CustomPreview(Geometry=alignobj_2.Geometry, Material=ColourSwatch(SwatchColor=RGBA(3, 162, 255, 122)))
preview_4 = CustomPreview(Geometry=knoll.Geo, Material=ColourSwatch(SwatchColor=RGBA(3, 162, 255, 122)))
