# Grasshopper definition script.gh (Grasshopper 1.0.7)
# plug-ins: DigitalCircularityToolkit

neg = Negative(Value=Slider(5000, range=1000..5000))
Z = UnitZ(Factor=neg)
rectangle = Rectangle(Plane=PlaneXY(0, 0, 0), XSize=Slider(15000, range=0..100000), YSize=Slider(15000, range=0..100000), Radius=0)  # -> Rectangle, Length
move = Move(Geometry=rectangle.Rectangle, Motion=Z)  # -> Geometry, Transform
number_slider = Slider(17, range=0..100)
pop2d = Populate2D(Region=rectangle.Rectangle, Count=Slider(32, range=10..100), Seed=1)
pop2d_2 = Populate2D(Region=move.Geometry, Count=Slider(32, range=10..100), Seed=Slider(23, range=1..100))
voronoi = Voronoi(Points=pop2d, Boundary=rectangle.Rectangle, BruteForceOverride=False)
voronoi_2 = Voronoi(Points=pop2d_2, Boundary=move.Geometry, BruteForceOverride=False)
crv = Curve([<curve referenced from the Rhino model> x34])
radialsig = RadialSignature(Curve=voronoi, NumSamples=number_slider)  # -> ComplexSignature, DistanceSignature, ProjectedCurve, Rays
radialsig_2 = RadialSignature(Curve=crv, NumSamples=number_slider)  # -> ComplexSignature, DistanceSignature, ProjectedCurve, Rays
planeobj = PlanarObject(Geometry=voronoi, NumSamples=50, Quantity=1, LengthBuffer=1, WidthBuffer=1, Thickness=-1)  # -> Object, EffectivePlane
planeobj_2 = PlanarObject(Geometry=crv, NumSamples=50, Quantity=1, LengthBuffer=1, WidthBuffer=1, Thickness=-1)  # -> Object, EffectivePlane
harmonicscomplex = HarmonicAnalysisComplex(ComplexSig=radialsig.ComplexSignature)
harmonicscomplex_2 = HarmonicAnalysisComplex(ComplexSig=radialsig_2.ComplexSignature)
dmeuclidean = EuclideanDistance(FVdemand=harmonicscomplex, FVsupply=harmonicscomplex_2, Power=1)
hungarian = Hungarian(DistanceMatrix=dmeuclidean)  # -> Assignment, Cost
item = ListItem(List=planeobj_2.Object, Index=hungarian.Assignment, Wrap=True)
alignobj = AlignToObject(SourceObject=item, TargetObject=planeobj.Object)  # -> Object, Geometry, Transform
panel = Panel(hungarian.Assignment)
