# Grasshopper definition huldiff_debug.gh (Grasshopper 1.0.7)
# plug-ins: DigitalCircularityToolkit

mesh = Mesh([<mesh referenced from the Rhino model> x65])
item = ListItem(List=mesh, Index=Slider(16, range=0..64), Wrap=True)
item_2 = ListItem(List=mesh, Index=Slider(0, range=0..64), Wrap=True)
item_3 = ListItem(List=mesh, Index=Slider(41, range=0..64), Wrap=True)
obj = Object(Geometry=item, NumSamples=50)
obj_2 = Object(Geometry=item_2, NumSamples=50)
obj_3 = Object(Geometry=item_3, NumSamples=50)
hulldiffdebug = HullDiffDebug(Demand=obj_3, Supply=obj_2)  # -> HullDemand, VDemand, HullSupply, VSupply, Distance, Intersection
objprops = ObjectProperties(Object=obj)  # -> Centroid, PCA1, PCA2, PCA3, Length, Width, Height, BoundingBox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
objprops_2 = ObjectProperties(Object=obj_3)  # -> Centroid, PCA1, PCA2, PCA3, Length, Width, Height, BoundingBox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
normalize = Normalize(Factor=1)
panel = Panel(hulldiffdebug.VDemand)
panel_2 = Panel(hulldiffdebug.VSupply)
panel_3 = Panel(hulldiffdebug.Distance)
mesh_2 = Mesh(hulldiffdebug.HullDemand)
mesh_3 = Mesh(hulldiffdebug.HullSupply)
Y = UnitY(Factor=objprops_2.Length)
preview = CustomPreview(Geometry=mesh_3, Material=ColourSwatch(SwatchColor=RGBA(0, 217, 255, 169)))
preview_2 = CustomPreview(Geometry=mesh_2, Material=ColourSwatch(SwatchColor=RGBA(207, 207, 207, 173)))
vec = VectorXYZ(XComponent=Slider(2168, range=0..5000), YComponent=objprops_2.Length, ZComponent=0)  # -> Vector, Length
mint = MeshIntersection(MeshesA=mesh_2, MeshesB=mesh_3)
move = Move(Geometry=mint, Motion=Y)  # -> Geometry, Transform
move_2 = Move(Motion=vec.Vector)  # -> Geometry, Transform
addition = Addition(A=panel, B=panel_2)
volume = Volume(Geometry=mint)  # -> Volume, Centroid
preview_3 = CustomPreview(Geometry=move.Geometry, Material=ColourSwatch(SwatchColor=RGBA(247, 255, 0, 169)))
panel_4 = Panel(volume.Volume)
preview_4 = CustomPreview(Geometry=move_2.Geometry, Material=ColourSwatch(SwatchColor=RGBA(77, 255, 0, 169)))
multiplication = Multiplication(A=volume.Volume, B="2")
subtraction = Subtraction(A=addition, B=multiplication)
subtraction_2 = Subtraction(A=panel, B=panel_2)
panel_5 = Panel(subtraction)
panel_6 = Panel(subtraction_2)
