# Grasshopper definition hulldiff_script.gh (Grasshopper 1.0.7)
# plug-ins: DigitalCircularityToolkit

mesh = Mesh([<mesh referenced from the Rhino model> x44])
mesh_2 = Mesh([<mesh referenced from the Rhino model> x21])
obj = Object(Geometry=mesh_2, NumSamples=50)
obj_2 = Object(Geometry=mesh, NumSamples=50)
item = ListItem(List=obj, Index=Slider(15, range=0..30), Wrap=True)
item_2 = ListItem(List=obj_2, Index=Slider(19, range=0..30), Wrap=True)
objprops = ObjectProperties(Object=item)  # -> Centroid, PCA1, PCA2, PCA3, Length, Width, Height, BoundingBox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
alignplane = AlignToPlane(Object=item_2, Plane=objprops.LocalPlane)  # -> Object, Geometry, Transform
objprops_2 = ObjectProperties(Object=alignplane.Object)  # -> Centroid, PCA1, PCA2, PCA3, Length, Width, Height, BoundingBox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
mesh_3 = Mesh(objprops.VolumeHull)
mesh_4 = Mesh(objprops_2.VolumeHull)
volume = Volume(Geometry=mesh_4)  # -> Volume, Centroid
mint = MeshIntersection(MeshesA=mesh_3, MeshesB=mesh_4)
mdif = MeshDifference(MeshesA=mesh_4, MeshesB=mesh_3)
volume_2 = Volume(Geometry=mesh_3)  # -> Volume, Centroid
mesh_5 = Mesh(mint)
volume_3 = Volume(Geometry=mdif)  # -> Volume, Centroid
panel = Panel(volume.Volume)
volume_4 = Volume(Geometry=mesh_5)  # -> Volume, Centroid
panel_2 = Panel(volume_2.Volume)
dmhull3d = HullDifference3D_GH(Demand=item, Supply=item_2)
subtraction = Subtraction(A=volume_2.Volume, B=volume_4.Volume)
addition = Addition(A=subtraction, B=volume_3.Volume)
panel_3 = Panel(dmhull3d)
panel_4 = Panel(addition)
