# Grasshopper definition hulltesting_script.gh (Grasshopper 1.0.7)
# plug-ins: DigitalCircularityToolkit

pt = Point([<point referenced from the Rhino model> x1240])
pointcloud = ToPointCloud(Points=pt)
crv = Curve(<curve referenced from the Rhino model>)
brep = Brep(<brep referenced from the Rhino model>)
mesh = Mesh(<mesh referenced from the Rhino model>)
geo = Geometry(brep)
planeobj = PlanarObject(Geometry=pointcloud, NumSamples=50, Quantity=1, LengthBuffer=1, WidthBuffer=1, Thickness=-1)  # -> Object, EffectivePlane
lineobj = LinearObject(Geometry=pointcloud, NumSamples=50, Quantity=1, LengthBuffer=1, Area=-1)  # -> Object, EffectiveLine
boxobj = BoxObject(Geometry=pointcloud, NumSamples=50, Quantity=1, LengthBuffer=1, WidthBuffer=1, HeightBuffer=1)  # -> Object, EffectiveBox
planarset = PlanarSet(PlanarObjs=planeobj.Object)  # -> EffectivePlane, Plane, EffectiveLength, EffectiveWidth, Thickness, Indexer, Objects, Centroids, Hulls
hull3d = VolumeHull(Object=<missing>, PlanarTolerance=0.0001)
linearset = LinearSet(LinearObjs=lineobj.Object)  # -> EffectiveLine, EffectiveLength, Area, CentroidPlane, Indexer, Objects, Centroids, Hulls
boxset = BoxSet(Objects=boxobj.Object)  # -> EffectiveBox, Plane, EffectiveLength, EffectiveWidth, EffectiveHeight, Indexer, Objects, Centroids, Hulls
geo_2 = Geometry(boxset.Hulls)
geo_3 = Geometry(linearset.Hulls)
geo_4 = Geometry(planarset.Hulls)
brep_2 = Brep(<brep referenced from the Rhino model>)
brep_3 = Brep(<brep referenced from the Rhino model>)
sint = SolidIntersection(BrepsA=brep_2, BrepsB=brep_3)
volume = Volume(Geometry=sint)  # -> Volume, Centroid
volume_2 = Volume(Geometry=brep_2)  # -> Volume, Centroid
volume_3 = Volume(Geometry=brep_3)  # -> Volume, Centroid
panel = Panel(volume_3.Volume)
panel_2 = Panel(volume_2.Volume)
panel_3 = Panel(volume.Volume)
division = Division(A=volume.Volume, B=volume_2.Volume)
division_2 = Division(A=volume.Volume, B=volume_3.Volume)
panel_4 = Panel(division_2)
panel_5 = Panel(division)
