# Grasshopper definition script.gh (Grasshopper 1.0.7)
# plug-ins: Pufferfish, DigitalCircularityToolkit, Human

number_slider = Slider(10000, range=0..10000)
rectangle = Rectangle(Plane=PlaneXY(0, 0, 0), XSize=Slider(10459, range=5000..20000), YSize=Slider(3000, range=0..3000), Radius=0)  # -> Rectangle, Length
Y = UnitY(Factor=Slider(10820, range=3000..20000))
rectangle_2 = Rectangle(Plane=PlaneXY(0, 0, 0), XSize=Slider(7687, range=0..10000), YSize=Slider(3000, range=0..3000), Radius=0)  # -> Rectangle, Length
range = Range(Domain=Domain(0, 1), Steps=Slider(5, range=2..20))
range_2 = Range(Domain=Domain(0, 1), Steps=Slider(10, range=2..20))
move = Move(Geometry=rectangle.Rectangle, Motion=Y)  # -> Geometry, Transform
range_3 = Range(Domain=Domain(0, 1), Steps=Slider(12, range=2..20))
range_4 = Range(Domain=Domain(0, 1), Steps=Slider(12, range=2..20))
paramrecgrid = ParameterRectangleGrid(Rectangle=move.Geometry, ParametersX=range, ParametersY=range_2)  # -> Cells, flatten(Points)
paramrecgrid_2 = ParameterRectangleGrid(Rectangle=rectangle_2.Rectangle, ParametersX=range_3, ParametersY=range_4)  # -> Cells, flatten(Points)
lng = ListLength(List=paramrecgrid.Points)
lng_2 = ListLength(List=paramrecgrid_2.Points)
pl = ConstructPlane(Origin=paramrecgrid.Points, XAxis=Vector(1, 0, 0), YAxis=Vector(0, 1, 0))
random = Random(Range=Domain(0, 1), Number=lng, Seed=Slider(10, range=1..10))
random_2 = Random(Range=Domain(0, 1), Number=lng, Seed=Slider(9, range=1..10))
random_3 = Random(Range=Domain(0, 1), Number=lng, Seed=Slider(10, range=1..10))
pl_2 = ConstructPlane(Origin=paramrecgrid_2.Points, XAxis=Vector(1, 0, 0), YAxis=Vector(0, 1, 0))
random_4 = Random(Range=Domain(0, 1), Number=lng_2, Seed=Slider(1, range=1..10))
random_5 = Random(Range=Domain(0, 1), Number=lng_2, Seed=Slider(5, range=1..10))
random_6 = Random(Range=Domain(0, 1), Number=lng_2, Seed=Slider(3, range=1..10))
number_slider_2 = Slider(101, range=50..250)
number_slider_3 = Slider(31, range=0..100)
number_slider_4 = Slider(101, range=50..250)
number_slider_5 = Slider(31, range=0..100)
multiplication = Multiplication(A=random, B=number_slider_2)
multiplication_2 = Multiplication(A=random_2, B=number_slider_2)
multiplication_3 = Multiplication(A=random_4, B=number_slider_4)
multiplication_4 = Multiplication(A=random_5, B=number_slider_4)
addition = Addition(A=multiplication, B=number_slider_3)
addition_2 = Addition(A=multiplication_2, B=number_slider_3)
multiplication_5 = Multiplication(A=random_3, B=Slider(3000, range=200..3000))
addition_3 = Addition(A=multiplication_3, B=number_slider_5)
addition_4 = Addition(A=multiplication_4, B=number_slider_5)
multiplication_6 = Multiplication(A=random_6, B=Slider(3000, range=200..3000))
addition_5 = Addition(A=multiplication_5, B=Slider(100, range=0..100))
addition_6 = Addition(A=multiplication_6, B=Slider(100, range=0..100))
box = CenterBox(Base=pl, X=addition, Y=addition_2, Z=addition_5)
Z = UnitZ(Factor=addition_5)
box_2 = CenterBox(Base=pl_2, X=addition_3, Y=addition_4, Z=addition_6)
Z_2 = UnitZ(Factor=addition_6)
move_2 = Move(Geometry=box, Motion=Z)  # -> Geometry, Transform
move_3 = Move(Geometry=box_2, Motion=Z_2)  # -> Geometry, Transform
brep = Brep(move_2.Geometry)
brep_2 = Brep(move_3.Geometry)
obj = Object(Geometry=brep, NumSamples=50, PCAOverride=Vector(0, 0, 0))
obj_2 = Object(Geometry=brep_2, NumSamples=50, PCAOverride=Vector(0, 0, 0))
preview = CustomPreview(Geometry=brep, Material=ColourSwatch(SwatchColor=RGBA(255, 255, 255, 169)))
preview_2 = CustomPreview(Geometry=brep_2, Material=ColourSwatch(SwatchColor=RGBA(255, 255, 255, 119)))
objinfo = ObjectInformation(Object=obj)  # -> Centroid, PCA1, PCA2, PCA3, Length, Width, Height, BoundingBox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
objinfo_2 = ObjectInformation(Object=obj_2)  # -> Centroid, PCA1, PCA2, PCA3, Length, Width, Height, BoundingBox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
featurevec = FeatureVector(X1=objinfo.Length, X2=objinfo.Width, X3=objinfo.Height)
featurevec_2 = FeatureVector(X1=objinfo_2.Length, X2=objinfo_2.Width, X3=objinfo_2.Height)
panel = Panel(featurevec)
panel_2 = Panel(featurevec_2)
dmeuclidean = EuclideanDistance(Demand=panel, Supply=panel_2, Power=1)
hungarian = Hungarian()  # -> Assignment, Cost
item = ListItem(List=paramrecgrid_2.Points, Index=hungarian.Assignment, Wrap=True)
vec2pt = Vector2Pt(PointA=item, PointB=paramrecgrid.Points, Unitize=False)  # -> Vector, Length
item_2 = ListItem(List=brep_2, Index=hungarian.Assignment, Wrap=True)
item_3 = ListItem(List=objinfo_2.Centroid, Index=hungarian.Assignment, Wrap=True)
move_4 = Move(Geometry=item_2, Motion=vec2pt.Vector)  # -> Geometry, Transform
ln = Line(StartPoint=objinfo.Centroid, EndPoint=item_3)
panel_3 = Panel(hungarian.Assignment)
preview_3 = CustomPreview(Geometry=move_4.Geometry, Material=ColourSwatch(SwatchColor=RGBA(0, 106, 255, 81)))
previewlw = CustomPreviewLineweights(Geometry=ln, Shader=ColourSwatch(SwatchColor=RGB(184, 184, 184)), Thickness=Slider(3, range=1..5), Absolute=False)
preview_4 = CustomPreview(Geometry=item_2, Material=ColourSwatch(SwatchColor=RGB(0, 106, 255)))
