# Grasshopper definition objects_script.gh (Grasshopper 1.0.7)
# plug-ins: DigitalCircularityToolkit, Human

line = Line(Line((7.243625225, -7.371512629, 0), (172.1406554, 125.3868886, 0)))
end = EndPoints(Curve=line)  # -> Start, End
vec2pt = Vector2Pt(PointA=end.Start, PointB=end.End, Unitize=False)  # -> Vector, Length
crv = Curve(<curve referenced from the Rhino model>)
brep = Brep(<brep referenced from the Rhino model>)
mesh = Mesh(<mesh referenced from the Rhino model>)
popgeo = PopulateGeometry(Geometry=brep, Count=Slider(100, range=100..500), Seed=1)
obj = Object_GH(Geometry=crv, NumSamples=50, PCAOverride=vec2pt.Vector)
Y = UnitY(Factor=Slider(500, range=500..3000))
pt = Point(popgeo)
move = Move(Geometry=pt, Motion=Y)  # -> Geometry, Transform
objpts = PointBasedObject(Points=move.Geometry, PCAOverride=Vector(0, 0, 0))
objinfo = ObjectInformation(Object=obj)  # -> Centroid, PCA1, PCA2, PCA3, Length, Width, Height, BoundingBox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
geo = Geometry(objinfo.AlignedGeometry)
box = Box(objinfo.BoundingBox)
multiplication = Multiplication(A=objinfo.Length, B=Slider(0.6, range=0..1))
line_2 = LineSDL(Start=objinfo.Centroid, Direction=objinfo.PCA1, Length=multiplication)
line_3 = LineSDL(Start=objinfo.Centroid, Direction=objinfo.PCA2, Length=multiplication)
line_4 = LineSDL(Start=objinfo.Centroid, Direction=objinfo.PCA3, Length=multiplication)
preview = CustomPreview(Geometry=geo, Material=ColourSwatch(SwatchColor=RGBA(187, 255, 105, 137)))
number_slider = Slider(4, range=1..4)
previewlw = CustomPreviewLineweights(Geometry=line_2, Shader=ColourSwatch(SwatchColor=RGB(250, 0, 0)), Thickness=number_slider, Absolute=False)
previewlw_2 = CustomPreviewLineweights(Geometry=line_3, Shader=ColourSwatch(SwatchColor=RGB(0, 54, 250)), Thickness=number_slider, Absolute=False)
previewlw_3 = CustomPreviewLineweights(Geometry=line_4, Shader=ColourSwatch(SwatchColor=RGB(0, 250, 21)), Thickness=number_slider, Absolute=False)
