# Grasshopper definition radialsig_script.gh (Grasshopper 1.0.7)
# plug-ins: DigitalCircularityToolkit

crv = Curve([<curve referenced from the Rhino model> x9])
brep = Brep([<brep referenced from the Rhino model> x102])
crv_2 = Curve([<curve referenced from the Rhino model> x13])
brep_2 = Brep([<brep referenced from the Rhino model> x55])
number_slider = Slider(20, range=2..100)
obj = Object(Geometry=brep, NumSamples=50)
obj_2 = Object(Geometry=brep_2, NumSamples=50)
radial2d = RadialSig2D(DesignObject=obj_2, NumSamples=number_slider)  # -> Signature, SampledPoints, Hull, StartPoint, FFT
radial2d_2 = RadialSig2D(DesignObject=obj, NumSamples=number_slider)  # -> Signature, SampledPoints, Hull, StartPoint, FFT
objprops = ObjectProperties(Object=obj)  # -> Centroid, PCA1, PCA2, PCA3, Length, Width, Height, BoundingBox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
objprops_2 = ObjectProperties(Object=obj_2)  # -> Centroid, PCA1, PCA2, PCA3, Length, Width, Height, BoundingBox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
graph = QuickGraph(radial2d_2.FFT, SortOrder=0)
graph_2 = QuickGraph(radial2d.FFT, SortOrder=0)
dmeuclidean = EuclideanDistance(Demand=radial2d.FFT, Supply=radial2d_2.FFT, Power=1)
hungarian = Hungarian(DistanceMatrix=dmeuclidean)  # -> Assignment, Cost
item = ListItem(List=obj, Index=hungarian.Assignment, Wrap=True)
matchlines = MatchLines(DemandPoints=objprops_2.Centroid, SupplyPoints=objprops.Centroid, AssignmentIndices=hungarian.Assignment)
alignobj = AlignToObject(SourceObject=item, TargetObject=obj_2)  # -> Object, Geometry, Transform
