# Grasshopper definition rockmatching_script.gh (Grasshopper 1.0.7)
# plug-ins: DigitalCircularityToolkit, Human

geo = Geometry(<brep referenced from the Rhino model>)
pipeline = GeometryPipeline(
    GroupByLayer=False,
    GroupByType=False,
    IncludeHidden=True,
    IncludeLocked=True,
    LayerFilter="*Default",
    NameFilter="*",
    SublayerFiltering=True,
    TypeFilter=32)
number_slider = Slider(20, range=5..20)
crv = Curve(<curve referenced from the Rhino model>)
popgeo = PopulateGeometry(Geometry=geo, Count=Slider(29, range=10..40), Seed=1)
preview = CustomPreview(Geometry=geo, Material=ColourSwatch(SwatchColor=RGBA(255, 255, 255, 143)))
boundary = BoundarySurfaces(Edges=crv)
preview_2 = CustomPreview(Geometry=pipeline, Material=ColourSwatch(SwatchColor=RGB(212, 212, 212)))
bbox = BoundingBox(Content=crv, Plane=PlaneXY(0, 0, 0))  # -> Box, Box_2
voronoi³ = Voronoi3D(Points=popgeo)  # -> Cells, Boundary
popgeo_2 = PopulateGeometry(Geometry=boundary, Count=Slider(23, range=5..25), Seed=1)
number_slider_2 = Slider(4, range=1..5)
number_slider_3 = Slider(2, range=1..2)
debrep = DeconstructBrep(Brep=voronoi³.Cells)  # -> Faces, Edges, Vertices
number_slider_4 = Slider(0.84, range=0.5..1)
planeobj = PlanarObject(Geometry=pipeline, NumSamples=50, Quantity=1, LengthBuffer=1, WidthBuffer=1, Thickness=-1, PCAOverride=Vector(0, 0, 0))  # -> Object, EffectivePlane
boxobj = BoxObject(
    Geometry=voronoi³.Cells,
    NumSamples=50,
    Quantity=1,
    LengthBuffer=1,
    WidthBuffer=1,
    HeightBuffer=1,
    PCAOverride=Vector(0, 0, 0))  # -> Object, EffectiveBox
boxobj_2 = BoxObject(NumSamples=50, Quantity=1, LengthBuffer=1, WidthBuffer=1, HeightBuffer=1, PCAOverride=Vector(0, 0, 0))  # -> Object, EffectiveBox
voronoi = Voronoi(Points=popgeo_2, Boundary=bbox.Box, BruteForceOverride=False)
planeobj_2 = PlanarObject(
    Geometry=voronoi,
    NumSamples=50,
    Quantity=1,
    LengthBuffer=number_slider_4,
    WidthBuffer=number_slider_4,
    Thickness=-1,
    PCAOverride=Vector(0, 0, 0))  # -> Object, EffectivePlane
boxset = BoxSet(Objects=boxobj_2.Object)  # -> EffectiveBox, Plane, EffectiveLength, EffectiveWidth, EffectiveHeight, Indexer, Objects, Centroids
boxset_2 = BoxSet(Objects=boxobj.Object)  # -> EffectiveBox, Plane, EffectiveLength, EffectiveWidth, EffectiveHeight, Indexer, Objects, Centroids
planarset = PlanarSet(PlanarObjs=planeobj.Object)  # -> EffectivePlane, Plane, EffectiveLength, EffectiveWidth, Thickness, Indexer, Objects, Centroids
pipe = Pipe(Curve=debrep.Edges, Radius=Slider(50, range=10..50), Caps=2)
planarset_2 = PlanarSet(PlanarObjs=planeobj_2.Object)  # -> EffectivePlane, Plane, EffectiveLength, EffectiveWidth, Thickness, Indexer, Objects, Centroids
preview_3 = CustomPreview(Geometry=pipe, Material=ColourSwatch(SwatchColor=RGBA(82, 82, 82, 122)))
preview_4 = CustomPreview(Geometry=boxset.EffectiveBox, Material=ColourSwatch(SwatchColor=RGBA(0, 153, 255, 80)))
preview_5 = CustomPreview(Geometry=planarset.EffectivePlane, Material=ColourSwatch(SwatchColor=RGBA(0, 153, 255, 151)))
preview_6 = CustomPreview(Geometry=planarset_2.EffectivePlane, Material=ColourSwatch(SwatchColor=RGBA(212, 212, 212, 152)))
previewlw = CustomPreviewLineweights(
    Geometry=voronoi,
    Shader=ColourSwatch(SwatchColor=RGBA(76, 76, 76, 193)),
    Thickness=Slider(3, range=1..5),
    Absolute=False)
featurevec = FeatureVector(X1=planarset_2.EffectiveLength, X2=planarset_2.EffectiveWidth)
featurevec_2 = FeatureVector(X1=boxset.EffectiveLength, X2=boxset.EffectiveWidth, X3=boxset.EffectiveHeight)
featurevec_3 = FeatureVector(X1=boxset_2.EffectiveLength, X2=boxset_2.EffectiveWidth, X3=boxset_2.EffectiveHeight)
featurevec_4 = FeatureVector(X1=planarset.EffectiveLength, X2=planarset.EffectiveWidth)
dmeuclidean = EuclideanDistance(Demand=featurevec, Supply=featurevec_4, Power=1)
dmasymm = AsymmEuclideanDistance(Demand=featurevec, Supply=featurevec_4, Power1=1, Power2=2)
dmasymm_2 = AsymmEuclideanDistance(Demand=featurevec_3, Supply=featurevec_2, Power1=1, Power2=2)
dmeuclidean_2 = EuclideanDistance(Demand=featurevec_3, Supply=featurevec_2, Power=1)
hungarian = Hungarian(DistanceMatrix=dmasymm)  # -> Assignment, Cost
hungarian_2 = Hungarian(DistanceMatrix=dmasymm_2)  # -> Assignment, Cost
item = ListItem(List=planarset.Objects, Index=hungarian.Assignment, Wrap=True)
matchlines = MatchLines(DemandPoints=planarset_2.Centroids, SupplyPoints=planarset.Centroids, AssignmentIndices=hungarian.Assignment)
alignobj = AlignToObject(SourceObject=item, TargetObject=planarset_2.Objects)  # -> Object, Geometry
matchlines_2 = MatchLines(DemandPoints=boxset_2.Centroids, SupplyPoints=boxset.Centroids, AssignmentIndices=hungarian_2.Assignment)
item_2 = ListItem(List=boxset.Objects, Index=hungarian_2.Assignment, Wrap=True)
preview_7 = CustomPreview(Geometry=alignobj.Geometry, Material=ColourSwatch(SwatchColor=RGB(0, 153, 255)))
alignobj_2 = AlignToObject(SourceObject=item_2, TargetObject=boxset_2.Objects)  # -> Object, Geometry
previewlw_2 = CustomPreviewLineweights(
    Geometry=matchlines,
    Shader=ColourSwatch(SwatchColor=RGB(115, 115, 115)),
    Thickness=Slider(2, range=1..5),
    Absolute=False)
preview_8 = CustomPreview(Geometry=alignobj_2.Geometry, Material=ColourSwatch(SwatchColor=RGB(0, 153, 255)))
previewlw_3 = CustomPreviewLineweights(
    Geometry=matchlines_2,
    Shader=ColourSwatch(SwatchColor=RGB(115, 115, 115)),
    Thickness=Slider(2, range=1..5),
    Absolute=False)
