# Grasshopper definition rocksandsticks_script.gh (Grasshopper 1.0.7)
# plug-ins: DigitalCircularityToolkit

mesh = Mesh([<mesh referenced from the Rhino model> x65])
brep = Brep([<brep referenced from the Rhino model> x52])
brep_2 = Brep(<brep referenced from the Rhino model>)
boxobj = BoxObject(Geometry=brep, NumSamples=50, Quantity=1, LengthBuffer=1, WidthBuffer=1, HeightBuffer=1)  # -> Object, EffectiveBox
planeobj = PlanarObject(Geometry=brep, NumSamples=50, Quantity=1, LengthBuffer=1, WidthBuffer=1, Thickness=-1)  # -> Object, EffectivePlane
boxobj_2 = BoxObject(Geometry=mesh, NumSamples=50, Quantity=1, LengthBuffer=1, WidthBuffer=1, HeightBuffer=1)  # -> Object, EffectiveBox
panel = Panel("-1")
planarset = PlanarSet(PlanarObjs=planeobj.Object)  # -> EffectivePlane, Plane, EffectiveLength, EffectiveWidth, Thickness, Indexer, Objects, Centroids, Hulls
boxset = BoxSet(Objects=boxobj_2.Object)  # -> EffectiveBox, Plane, EffectiveLength, EffectiveWidth, EffectiveHeight, Indexer, Objects, Centroids, Hulls
boxset_2 = BoxSet(Objects=boxobj.Object)  # -> EffectiveBox, Plane, EffectiveLength, EffectiveWidth, EffectiveHeight, Indexer, Objects, Centroids, Hulls
wires = BrepWireframe(Brep=brep_2, Density=Slider(3, range=1..20))
boxscore = BoxScore(BoxObject=boxset.Objects)
boxscore_2 = BoxScore(BoxObject=boxset_2.Objects)
item = ListItem(List=wires, Index=Slider(5, range=0..60), Wrap=True)
planescore = PlaneScore(Object=planarset.Objects)
panel_2 = Panel(boxscore)
panel_3 = Panel(planescore)
panel_4 = Panel(boxscore_2)
preview = CustomPreview(Material=ColourSwatch(SwatchColor=RGBA(199, 199, 199, 204)))
wires_2 = BrepWireframe(Brep=brep, Density=Slider(5, range=1..100))
