# Grasshopper definition box_matching_script.gh (Grasshopper 1.0.7)
# plug-ins: DigitalCircularityToolkit, Human

# SUPPLY
brep = Brep([<brep referenced from the Rhino model> x169])
# DEMAND
brep_2 = Brep([<brep referenced from the Rhino model> x66])
boxobj = BoxObject(Geometry=brep, NumSamples=50, Quantity=1, LengthBuffer=1, WidthBuffer=1, HeightBuffer=1, PCAOverride=Vector(0, 0, 0))  # -> Object, EffectiveBox
boxobj_2 = BoxObject(
    Geometry=brep_2,
    NumSamples=50,
    Quantity=1,
    LengthBuffer=Slider(0.89, range=0.7..1),
    WidthBuffer=1,
    HeightBuffer=1,
    PCAOverride=Vector(0, 0, 0))  # -> Object, EffectiveBox
boxset = BoxSet(Objects=boxobj_2.Object)  # -> EffectiveBox, Plane, EffectiveLength, EffectiveWidth, EffectiveHeight, Indexer, Objects
boxset_2 = BoxSet(Objects=boxobj.Object)  # -> EffectiveBox, Plane, EffectiveLength, EffectiveWidth, EffectiveHeight, Indexer, Objects
multiplication = Multiplication(A=boxset.EffectiveWidth, B=boxset.EffectiveHeight)
multiplication_2 = Multiplication(A=boxset_2.EffectiveWidth, B=boxset_2.EffectiveHeight)
preview = CustomPreview(Geometry=boxset_2.EffectiveBox, Material=ColourSwatch(SwatchColor=RGBA(120, 120, 120, 161)))
preview_2 = CustomPreview(Geometry=boxset.EffectiveBox, Material=ColourSwatch(SwatchColor=RGBA(199, 199, 199, 182)))
deplane = DeconstructPlane(Plane=boxset_2.Plane)  # -> Origin, XAxis, YAxis, ZAxis
deplane_2 = DeconstructPlane(Plane=boxset.Plane)  # -> Origin, XAxis, YAxis, ZAxis
featurevec = FeatureVector(X1=boxset.EffectiveLength, X2=multiplication)
featurevec_2 = FeatureVector(X1=boxset_2.EffectiveLength, X2=multiplication_2)
panel = Panel(featurevec)
panel_2 = Panel(featurevec_2)
dmeuclidean = EuclideanDistance(Demand=featurevec, Supply=featurevec_2, Power=1)
hungarian = Hungarian(DistanceMatrix=dmeuclidean)  # -> Assignment, Cost
number_slider = Slider(9, range=0..65)
item = ListItem(List=deplane.Origin, Index=hungarian.Assignment, Wrap=True)
ln = Line(StartPoint=deplane_2.Origin, EndPoint=item)
item_2 = ListItem(List=boxset.EffectiveBox, Index=number_slider, Wrap=True)
item_3 = ListItem(List=ln, Index=number_slider, Wrap=True)
item_4 = ListItem(List=hungarian.Assignment, Index=number_slider, Wrap=True)
item_5 = ListItem(List=boxset.Objects, Index=number_slider, Wrap=True)
previewlw = CustomPreviewLineweights(Geometry=ln, Shader=ColourSwatch(SwatchColor=RGB(117, 117, 117)), Thickness=Slider(1, range=1..4), Absolute=False)
item_6 = ListItem(List=boxset_2.EffectiveBox, Index=item_4, Wrap=True)
item_7 = ListItem(List=boxset_2.Objects, Index=item_4, Wrap=True)
swatch = ColourSwatch(SwatchColor=RGB(0, 204, 255))
alignobj = AlignToObject(SourceObject=item_7, TargetObject=item_5)  # -> Object, Geometry
preview_3 = CustomPreview(Geometry=item_6, Material=swatch)
previewlw_2 = CustomPreviewLineweights(Geometry=item_3, Shader=swatch, Thickness=Slider(4, range=1..4), Absolute=False)
preview_4 = CustomPreview(Geometry=item_2, Material=ColourSwatch(SwatchColor=RGB(194, 194, 194)))
debrep = DeconstructBrep(Brep=alignobj.Geometry)  # -> Faces, Edges, Vertices
previewlw_3 = CustomPreviewLineweights(
    Geometry=debrep.Edges,
    Shader=ColourSwatch(SwatchColor=RGB(0, 204, 255)),
    Thickness=Slider(4, range=1..4),
    Absolute=False)
