# Grasshopper definition plane_matching_script.gh (Grasshopper 1.0.7)
# plug-ins: Human, DigitalCircularityToolkit

# SUPPLY
brep = Brep([<brep referenced from the Rhino model> x169])
# DEMAND
brep_2 = Brep([<brep referenced from the Rhino model> x66])
sphereobj = SphericalObject(Geometry=brep, NumSamples=50, Quantity=1, RadiusBuffer=1, PCAOverride=Vector(0, 0, 0))  # -> Object, EffectiveSphere
sphereobj_2 = SphericalObject(Geometry=brep_2, NumSamples=50, Quantity=1, RadiusBuffer=1, PCAOverride=Vector(0, 0, 0))  # -> Object, EffectiveSphere
planeobj = PlanarObject(Geometry=brep, NumSamples=50, Quantity=1, LengthBuffer=1, WidthBuffer=1, Thickness=-1, PCAOverride=Vector(0, 0, 0))  # -> Object, EffectivePlane
planeobj_2 = PlanarObject(Geometry=brep_2, NumSamples=50, Quantity=1, LengthBuffer=1, WidthBuffer=1, Thickness=-1, PCAOverride=Vector(0, 0, 0))  # -> Object, EffectivePlane
planarset = PlanarSet(PlanarObjs=planeobj_2.Object)  # -> EffectivePlane, Plane, EffectiveLength, EffectiveWidth, Indexer, Objects
planarset_2 = PlanarSet(PlanarObjs=planeobj.Object)  # -> EffectivePlane, Plane, EffectiveLength, EffectiveWidth, Indexer, Objects
division = Division(A=planarset.EffectiveLength, B=planarset.EffectiveWidth)
division_2 = Division(A=planarset_2.EffectiveLength, B=planarset_2.EffectiveWidth)
preview = CustomPreview(Geometry=[brep_2, brep], Material=ColourSwatch(SwatchColor=RGBA(196, 196, 196, 161)))
deplane = DeconstructPlane(Plane=planarset_2.Plane)  # -> Origin, XAxis, YAxis, ZAxis
deplane_2 = DeconstructPlane(Plane=planarset.Plane)  # -> Origin, XAxis, YAxis, ZAxis
featurevec = FeatureVector(X1=planarset.EffectiveLength, X2=division)
featurevec_2 = FeatureVector(X1=planarset_2.EffectiveLength, X2=division_2)
dmeuclidean = EuclideanDistance(Demand=featurevec, Supply=featurevec_2, Power=1)
# CENTROID OF DEMAND
# CENTROID OF SUPPLY
hungarian = Hungarian(DistanceMatrix=dmeuclidean)  # -> Assignment, Cost
number_slider = Slider(28, range=0..65)
item = ListItem(List=deplane.Origin, Index=hungarian.Assignment, Wrap=True)
ln = Line(StartPoint=deplane_2.Origin, EndPoint=item)
item_2 = ListItem(List=ln, Index=number_slider, Wrap=True)
item_3 = ListItem(List=hungarian.Assignment, Index=number_slider, Wrap=True)
item_4 = ListItem(List=planarset.EffectivePlane, Index=number_slider, Wrap=True)
item_5 = ListItem(List=planeobj_2.Object, Index=number_slider, Wrap=True)
item_6 = ListItem(List=planeobj.Object, Index=item_3, Wrap=True)
previewlw = CustomPreviewLineweights(Geometry=ln, Shader=ColourSwatch(SwatchColor=RGB(117, 117, 117)), Thickness=Slider(1, range=1..4), Absolute=False)
item_7 = ListItem(List=planarset_2.EffectivePlane, Index=item_3, Wrap=True)
alignobj = AlignToObject(SourceObject=item_6, TargetObject=item_5)  # -> Object, Geometry
previewlw_2 = CustomPreviewLineweights(
    Geometry=item_2,
    Shader=ColourSwatch(SwatchColor=RGBA(0, 204, 255, 173)),
    Thickness=Slider(4, range=1..4),
    Absolute=False)
preview_2 = CustomPreview(Geometry=item_4, Material=ColourSwatch(SwatchColor=RGBA(194, 194, 194, 67)))
preview_3 = CustomPreview(Geometry=item_7, Material=ColourSwatch(SwatchColor=RGB(0, 204, 255)))
debrep = DeconstructBrep(Brep=alignobj.Geometry)  # -> Faces, Edges, Vertices
previewlw_3 = CustomPreviewLineweights(
    Geometry=debrep.Edges,
    Shader=ColourSwatch(SwatchColor=RGB(0, 204, 255)),
    Thickness=Slider(4, range=1..4),
    Absolute=False)
