# Grasshopper definition sphere_matching_script.gh (Grasshopper 1.0.7)
# plug-ins: Human, DigitalCircularityToolkit

# SUPPLY
brep = Brep([<brep referenced from the Rhino model> x169])
# DEMAND
brep_2 = Brep([<brep referenced from the Rhino model> x66])
sphereobj = SphericalObject(Geometry=brep, NumSamples=50, Quantity=1, RadiusBuffer=1, PCAOverride=Vector(0, 0, 0))  # -> Object, EffectiveSphere
sphereobj_2 = SphericalObject(Geometry=brep_2, NumSamples=50, Quantity=1, RadiusBuffer=1, PCAOverride=Vector(0, 0, 0))  # -> Object, EffectiveSphere
sphereset = SphereSet(SphereObjs=sphereobj_2.Object)  # -> EffectiveSphere, Plane, EffectiveRadius, Indexer, Objects
sphereset_2 = SphereSet(SphereObjs=sphereobj.Object)  # -> EffectiveSphere, Plane, EffectiveRadius, Indexer, Objects
area = Area(Geometry=sphereset_2.EffectiveSphere)  # -> Area, Centroid
area_2 = Area(Geometry=sphereset.EffectiveSphere)  # -> Area, Centroid
featurevec = FeatureVector(X1=area_2.Area)
featurevec_2 = FeatureVector(X1=area.Area)
dmeuclidean = EuclideanDistance(Demand=featurevec, Supply=featurevec_2, Power=1)
hungarian = Hungarian(DistanceMatrix=dmeuclidean)  # -> Assignment, Cost
number_slider = Slider(42, range=0..65)
item = ListItem(List=area.Centroid, Index=hungarian.Assignment, Wrap=True)
ln = Line(StartPoint=area_2.Centroid, EndPoint=item)
item_2 = ListItem(List=hungarian.Assignment, Index=number_slider, Wrap=True)
item_3 = ListItem(List=sphereset.EffectiveSphere, Index=number_slider, Wrap=True)
item_4 = ListItem(List=ln, Index=number_slider, Wrap=True)
item_5 = ListItem(List=sphereobj_2.Object, Index=number_slider, Wrap=True)
item_6 = ListItem(List=sphereobj.Object, Index=item_2, Wrap=True)
previewlw = CustomPreviewLineweights(Geometry=ln, Shader=ColourSwatch(SwatchColor=RGB(117, 117, 117)), Thickness=Slider(1, range=1..4), Absolute=False)
item_7 = ListItem(List=sphereset_2.EffectiveSphere, Index=item_2, Wrap=True)
swatch = ColourSwatch(SwatchColor=RGBA(0, 204, 255, 173))
alignobj = AlignToObject(SourceObject=item_6, TargetObject=item_5)  # -> Object, Geometry
preview = CustomPreview(Geometry=item_7, Material=swatch)
previewlw_2 = CustomPreviewLineweights(Geometry=item_4, Shader=swatch, Thickness=Slider(4, range=1..4), Absolute=False)
preview_2 = CustomPreview(Geometry=item_3, Material=ColourSwatch(SwatchColor=RGBA(194, 194, 194, 67)))
debrep = DeconstructBrep(Brep=alignobj.Geometry)  # -> Faces, Edges, Vertices
previewlw_3 = CustomPreviewLineweights(
    Geometry=debrep.Edges,
    Shader=ColourSwatch(SwatchColor=RGB(0, 204, 255)),
    Thickness=Slider(4, range=1..4),
    Absolute=False)
