# Grasshopper definition specific_objects_script.gh (Grasshopper 1.0.7)
# plug-ins: DigitalCircularityToolkit, Human

pt = Point([<point referenced from the Rhino model> x1240])
crv = Curve(<curve referenced from the Rhino model>)
brep = Brep(<brep referenced from the Rhino model>)
mesh = Mesh(<mesh referenced from the Rhino model>)
pointcloud = ToPointCloud(Points=pt)
preview = CustomPreview(Geometry=[crv, brep, mesh, pt], Material=ColourSwatch(SwatchColor=RGBA(214, 214, 214, 184)))
geo = Geometry(brep)
sphereobj = SphericalObject(Geometry=geo, NumSamples=50, Quantity=1, RadiusBuffer=Slider(0.95, range=0..1.5), PCAOverride=Vector(0, 0, 0))  # -> Object, EffectiveSphere
lineobj = LinearObject(Geometry=geo, NumSamples=50, Quantity=1, LengthBuffer=Slider(1.5, range=0..1.5), Area=-1, PCAOverride=Vector(0, 0, 0))  # -> Object, EffectiveLine
boxobj = BoxObject(
    Geometry=geo,
    NumSamples=50,
    Quantity=1,
    LengthBuffer=Slider(1.09, range=0..1.5),
    WidthBuffer=Slider(1.2, range=0..1.5),
    HeightBuffer=Slider(0.24, range=0..1.5),
    PCAOverride=Vector(0, 0, 0))  # -> Object, EffectiveBox
obj = Object(Geometry=geo, NumSamples=50, PCAOverride=Vector(0, 0, 0))
planeobj = PlanarObject(
    Geometry=geo,
    NumSamples=50,
    Quantity=1,
    LengthBuffer=Slider(1.22, range=0..1.5),
    WidthBuffer=Slider(1.04, range=0..1.5),
    Thickness=-1,
    PCAOverride=Vector(0, 0, 0))  # -> Object, EffectivePlane
swatch = ColourSwatch(SwatchColor=RGBA(0, 170, 255, 106))
previewlw = CustomPreviewLineweights(Geometry=lineobj.EffectiveLine, Shader=swatch, Thickness=Slider(5, range=1..5), Absolute=False)
preview_2 = CustomPreview(Geometry=boxobj.EffectiveBox, Material=swatch)
rotate = RotateObject(Object=obj, RotationAxis=1, RotationDegrees=Slider(108, range=0..360))  # -> RotatedObject, RotatedGeometry
