# Grasshopper definition utilities_script.gh (Grasshopper 1.0.7)
# plug-ins: DigitalCircularityToolkit

mesh = Mesh(<mesh referenced from the Rhino model>)
crv = Curve(<curve referenced from the Rhino model>)
brep = Brep(<brep referenced from the Rhino model>)
obj = Object(Geometry=brep, NumSamples=50, PCAOverride=Vector(0, 0, 0))
obj_2 = Object(Geometry=crv, NumSamples=50, PCAOverride=Vector(0, 0, 0))
sphereobj = SphericalObject(Geometry=brep, NumSamples=50, Quantity=1, RadiusBuffer=1, PCAOverride=Vector(0, 0, 0))  # -> Object, EffectiveSphere
align = Align(SourceObject=obj_2, TargetObject=obj)  # -> Object, Geometry
objinfo = ObjectInformation(Object=align.Object)  # -> Centroid, PCA1, PCA2, PCA3, Length, Width, Height, BoundingBox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
pt = Point(objinfo.SampledPoints)
