# Grasshopper definition assignment.gh (Grasshopper 1.0.7)
# plug-ins: DigitalCircularityToolkit, Human

pipeline = GeometryPipeline(
    GroupByLayer=False,
    GroupByType=False,
    IncludeHidden=True,
    IncludeLocked=True,
    LayerFilter="*Demand",
    NameFilter="*",
    SublayerFiltering=True,
    TypeFilter=4)
brep = Brep([<brep referenced from the Rhino model> x157])
lineobj = LinearObject(
    Geometry=pipeline,
    NumSamples=50,
    Quantity=1,
    LengthBuffer=1,
    Area=Slider(10, range=10..100),
    PCAOverride=Vector(0, 0, 0))  # -> Object, EffectiveLine
preview = CustomPreview(Geometry=brep, Material=ColourSwatch(SwatchColor=RGB(255, 255, 255)))
lineobj_2 = LinearObject(Geometry=brep, NumSamples=50, Quantity=1, LengthBuffer=1, Area=-1, PCAOverride=Vector(0, 0, 0))  # -> Object, EffectiveLine
linearset = LinearSet(LinearObjs=lineobj.Object)  # -> EffectiveLine, EffectiveLength, Area, CentroidPlane, Indexer, Objects, Centroids
linearset_2 = LinearSet(LinearObjs=lineobj_2.Object)  # -> EffectiveLine, EffectiveLength, Area, CentroidPlane, Indexer, Objects, Centroids
featurevec = FeatureVector(X1=linearset_2.EffectiveLength, X2=linearset_2.Area)
featurevec_2 = FeatureVector(X1=linearset.EffectiveLength, X2=linearset.Area)
dmasymm = AsymmEuclideanDistance(Demand=featurevec_2, Supply=featurevec, Power1=1, Power2=2)
hungarian = Hungarian(DistanceMatrix=dmasymm)  # -> Assignment, Cost
item = ListItem(List=linearset_2.Objects, Index=hungarian.Assignment, Wrap=True)
item_2 = ListItem(List=linearset_2.EffectiveLine, Index=hungarian.Assignment, Wrap=True)
swatch = ColourSwatch(SwatchColor=RGBA(0, 204, 255, 166))
preview_2 = CustomPreview(Geometry=item_2, Material=swatch)
matchlines = MatchLines(DemandPoints=linearset.Centroids, SupplyPoints=linearset_2.Centroids, AssignmentIndices=hungarian.Assignment)
alignobj = AlignToObject(SourceObject=item, TargetObject=linearset.Objects)  # -> Object, Geometry
preview_3 = CustomPreview(Geometry=alignobj.Geometry, Material=swatch)
previewlw = CustomPreviewLineweights(
    Geometry=matchlines,
    Shader=ColourSwatch(SwatchColor=RGBA(0, 204, 255, 166)),
    Thickness=Slider(1, range=1..5),
    Absolute=False)
