# Grasshopper definition object_testing.gh (Grasshopper 1.0.7)
# plug-ins: DigitalCircularityToolkit

# BARS
brep = Brep([<brep referenced from the Rhino model> x162])
# SQUIGGLY BARS
brep_2 = Brep([<brep referenced from the Rhino model> x102])
# KARL-JOHAN MESH
mesh = Mesh(<mesh referenced from the Rhino model>)
# KARL-JOHAN POINTCLOUD
pt = Point([<point referenced from the Rhino model> x1240])
# CURVES
crv = Curve([<curve referenced from the Rhino model> x34])
# ROCK MESHES
mesh_2 = Mesh([<mesh referenced from the Rhino model> x65])
pointcloud = ToPointCloud(Points=pt)
planeobj = PlanarObject(Geometry=brep_2, NumSamples=50, Quantity=1, LengthBuffer=1, WidthBuffer=1, Thickness=-1)  # -> Object, EffectivePlane
planeobj_2 = PlanarObject(Geometry=brep, NumSamples=50, Quantity=1, LengthBuffer=1, WidthBuffer=1, Thickness=-1)  # -> Object, EffectivePlane
number_slider = Slider(30, range=20..40)
planaroutline = PlanarOutline(Object=planeobj.Object)
radialsig = RadialSignature(Curve=planaroutline, NumSamples=number_slider)  # -> ComplexSignature, DistanceSignature, ProjectedCurve, Rays
planaroutline_2 = PlanarOutline(Object=planeobj_2.Object)
radialsig_2 = RadialSignature(Curve=planaroutline_2, NumSamples=number_slider)  # -> ComplexSignature, DistanceSignature, ProjectedCurve, Rays
harmonicscomplex = HarmonicAnalysisComplex(ComplexSig=radialsig.ComplexSignature)  # -> simplify(HarmonicFeatureVector)
graph = QuickGraph(radialsig.DistanceSignature, SortOrder=0)
harmonicsreal = HarmonicAnalysisReal(Signature=radialsig.DistanceSignature)  # -> simplify(HarmonicFeatureVector)
harmonicscomplex_2 = HarmonicAnalysisComplex(ComplexSig=radialsig_2.ComplexSignature)  # -> simplify(HarmonicFeatureVector)
panel = Panel(harmonicsreal)
graph_2 = QuickGraph(radialsig_2.DistanceSignature, SortOrder=0)
harmonicsreal_2 = HarmonicAnalysisReal(Signature=radialsig_2.DistanceSignature)  # -> simplify(HarmonicFeatureVector)
graph_3 = QuickGraph(harmonicsreal, SortOrder=0)
graph_4 = QuickGraph(harmonicscomplex, SortOrder=0)
panel_2 = Panel(harmonicsreal_2)
graph_5 = QuickGraph(harmonicsreal_2, SortOrder=0)
graph_6 = QuickGraph(harmonicscomplex_2, SortOrder=0)
panel_3 = Panel(harmonicscomplex_2)
dmeuclidean = EuclideanDistance(FVdemand=harmonicscomplex, FVsupply=harmonicscomplex_2, Power=1)
hungarian = Hungarian(DistanceMatrix=dmeuclidean)  # -> Assignment, Cost
item = ListItem(List=planeobj_2.Object, Index=hungarian.Assignment, Wrap=True)
alignobj = AlignToObject(SourceObject=item, TargetObject=planeobj.Object)  # -> Object, Geometry, Transform
