# Grasshopper definition spaghetti_maker.gh (Grasshopper 1.0.7)
# plug-ins: ClipperComponents, OpenNest

length_width_ratio_max = Slider(0.2, range=0.1..1)
number_of_buildings_2 = Slider(200, range=2..200)
width_max = Slider(10, range=1..10)
length_width_ratio_max_2 = Slider(3.18, range=1..10)
width_min = Slider(1, range=1..10)
dom = ConstructDomain(DomainStart=length_width_ratio_max, DomainEnd=length_width_ratio_max_2)
dom_2 = ConstructDomain(DomainStart=width_min, DomainEnd=width_max)
random = Random(Range="0 to 1", Number=number_of_buildings_2, Seed="35888")
graph = GraphMapper(random, x0=0, x1=1, y0=0, y1=1, Cx=0.467246443, Cy=0.2043476701, container_name="Conic")
random_2 = Random(Range=dom_2, Number=number_of_buildings_2, Seed=2)
random_3 = Random(Range="0 to 64000", Number=number_of_buildings_2, Seed="88", Integers=True)
# https://discourse.mcneel.com/t/generation-of-random-building-shapes-in-grasshopper/112825
# 21/11/2020
# Laurent Delrieu
remap = RemapNumbers(Value=graph, Source=Domain(0, 1), Target=dom)  # -> Mapped, Clipped
multiplication = Multiplication(A=random_2, B=remap.Mapped)
dom_3 = ConstructDomain(DomainStart=0, DomainEnd=random_2)
dom_4 = ConstructDomain(DomainStart=0, DomainEnd=multiplication)
rectangle = Rectangle(Plane=PlaneXY(0, 0, 0), XSize=dom_3, YSize=dom_4, Radius=0)  # -> Rectangle, Length
partition = PartitionList(List=rectangle.Rectangle, Size="2")
partition_2 = PartitionList(List=random_3, Size="2")
item = ListItem(List=partition_2, Index=0, Wrap=True)  # -> Item, Item1
item_2 = ListItem(List=partition, Index=0, Wrap=True)  # -> Item, Item1
pop2d = Populate2D(Region=item_2.Item1, Count="1", Seed=item.Item1)
pop2d_2 = Populate2D(Region=item_2.Item, Count="1", Seed=item.Item)
vec2pt = Vector2Pt(PointA=pop2d_2, PointB=pop2d, Unitize=False)  # -> Vector, Length
move = Move(Geometry=item_2.Item1, Motion=vec2pt.Vector)  # -> Geometry, Transform
polyboolean = PolylineBoolean(
    A=item_2.Item,
    B=move.Geometry,
    BooleanType="1",
    Plane=Plane(origin=(0, 0, 0), x=(0, 0, 0), y=(0, 0, 0)),
    Tolerance=0.01,
    EvenOdd=True)  # -> simplify(Result)
rectangle_2 = Rectangle(Plane=PlaneXY(0, 0, 0), XSize="150", YSize="100", Radius=0)  # -> Rectangle, Length
opennest = OpenNest(
    Sheets=rectangle_2.Rectangle,
    Geo=flatten(polyboolean),
    Spacing="5",
    Placement=0,
    Tolerance=0.1,
    Rotations="1",
    Iterations=1,
    Seed=1,
    Reset=True,
    Run=False)  # -> Sheets, Geo, ID, Transform, IDS
Y = UnitY(Factor=Slider(117, range=1..200))
move_2 = Move(Geometry=opennest.Geo, Motion=Y)  # -> Geometry, Transform
lng = ListLength(List=opennest.Geo)
amoments = AreaMoments(Geometry=move_2.Geometry)  # -> Area, Centroid, Inertia, InertiaError, Secondary, SecondaryError, Gyration
random_4 = Random(Range=Domain(0, 1), Number=lng, Seed=2)
multiplication_2 = Multiplication(A=random_4, B=Slider(200, range=10..300))
addition = Addition(A=multiplication_2, B=Slider(50, range=10..100))
Z = UnitZ(Factor=addition)
move_3 = Move(Geometry=amoments.Centroid, Motion=Z)  # -> Geometry, Transform
ln = Line(StartPoint=amoments.Centroid, EndPoint=move_3.Geometry)
divide = DivideCurve(Curve=ln, Count=Slider(3, range=2..7), Kinks=False)  # -> simplify(Points), Tangents, Parameters
dom_5 = ConstructDomain(DomainStart=0, DomainEnd=Slider(100, range=10..100))
lng_2 = ListLength(List=ln)
lng_3 = ListLength(List=divide.Points)
random_5 = Random(Range=dom_5, Number=lng_2, Seed=Slider(21, range=1..50))  # -> graft(Random)
random_6 = Random(Range=dom_5, Number=lng_2, Seed=2)  # -> graft(Random)
panel = Panel(divide.Points)
int = Integer(simplify(random_5))
int_2 = Integer(simplify(random_6))
random_7 = Random(Range=Domain(0, 1), Number=lng_3, Seed=int)  # -> simplify(Random)
random_8 = Random(Range=Domain(0, 1), Number=lng_3, Seed=int_2)  # -> simplify(Random)
multiplication_3 = Multiplication(A=random_7, B=Slider(34, range=10..100))
multiplication_4 = Multiplication(A=random_8, B=Slider(17, range=10..100))
panel_2 = Panel(multiplication_4)
vec = VectorXYZ(XComponent=multiplication_4, YComponent=multiplication_3, ZComponent=0)  # -> Vector, Length
move_4 = Move(Geometry=divide.Points, Motion=vec.Vector)  # -> Geometry, Transform
intcrv = Interpolate(Vertices=move_4.Geometry, Degree=3, Periodic=False, KnotStyle=1)  # -> flatten(Curve), Length, Domain
extrcrv = ExtrudeAlong(Base=move_2.Geometry, Curve=intcrv.Curve)
cap = CapHoles(Brep=extrcrv)
