# Grasshopper definition script.gh (Grasshopper 1.0.7)
# plug-ins: DigitalCircularityToolkit, Human

# ----
# A random assortment
# of geometries
geo = Geometry([<brep referenced from the Rhino model> x8, <mesh referenced from the Rhino model> x24, <brep referenced from the Rhino model> x25, <mesh referenced from the Rhino model>, <brep referenced from the Rhino model> x10, <mesh referenced from the Rhino model> x3, <brep referenced from the Rhino model> x31])
obj = Object(Geometry=geo, NumSamples=50)

# ----
# Knoll:
# Sometimes the input
# geometry isn't nicely organized.
# Use Knoll to align and orient everything
# consistently
number_slider = Slider(500, range=100..500)
knoll = Knoll(
    Objects=obj,
    OriginPlane=Plane(origin=(0, 0, 0), x=(0, 1, 0), y=(1, 0, 0)),
    NumRows=Slider(4, range=2..10),
    RowSpacing=number_slider,
    ColSpacing=Slider(240, range=100..500))  # -> Objects, Geo

# ----
# AlignToPlane:
# Move an object and orient it
# to align to an arbitrary plane
number_slider_2 = Slider(40, range=0..101)
pt = Point(<point referenced from the Rhino model>)
item = ListItem(List=knoll.Objects, Index=number_slider_2, Wrap=True)
pl = ConstructPlane(Origin=pt, XAxis=Vector(1, 0, 0), YAxis=Vector(0, 1, 0))
alignplane = AlignToPlane(Object=item, Plane=pl)  # -> Object, Geometry, Transform
preview = CustomPreview(Geometry=alignplane.Geometry, Material=ColourSwatch(SwatchColor=RGB(0, 174, 255)))

# ----
# Select object here
number_slider_3 = Slider(31, range=0..101)
item_2 = ListItem(List=knoll.Objects, Index=number_slider_3, Wrap=True)

preview_2 = CustomPreview(Geometry=knoll.Geo, Material=ColourSwatch(SwatchColor=RGBA(255, 255, 255, 202)))

# ----
# PlanarOutline:
# Project the outline of
# an object onto a plane.
# 
# - Default determines best fit plane
# - Useful to convert into a planar
# object or for HarmonicAnalysis (see next tutorial)
# Select an object
# Try rotating the projection plane
number_slider_4 = Slider(0, range=0..180)
rad = Radians(Degrees=number_slider_4)
item_3 = ListItem(List=knoll.Objects, Index=Slider(55, range=0..101), Wrap=True)
pl_2 = ConstructPlane(Origin=Point(0, 0, 0), XAxis=Vector(1, 0, 0), YAxis=Vector(0, 1, 0))
X = UnitX(Factor=1)
rot3d = Rotate3D(Geometry=pl_2, Angle=rad, Center=Point(0, 0, 0), Axis=X)  # -> Geometry, Transform
planaroutline = PlanarOutline(Object=item_3, Plane=rot3d.Geometry)
number_slider_5 = Slider(3, range=1..5)
previewlw = CustomPreviewLineweights(Geometry=planaroutline, Shader=ColourSwatch(SwatchColor=RGB(0, 174, 255)), Thickness=number_slider_5, Absolute=False)

# ----
# Normalize:
# If the dimensions in your Feature Vector
# have widely different magnitudes,
# normalizing them to the
# same scale will make sure they are all
# equally important
objprops = ObjectProperties(Object=knoll.Objects)  # -> Centroid, PCA1, PCA2, PCA3, Length, Width, Height, BoundingBox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
panel = Panel(objprops.Length)
number_slider_6 = Slider(100, range=0..100)
normalize = Normalize(Values=objprops.Height, Factor=number_slider_6)
normalize_2 = Normalize(Values=objprops.Width, Factor=number_slider_6)
normalize_3 = Normalize(Values=panel, Factor=number_slider_6)
panel_2 = Panel(normalize_3)
featurevec = FeatureVector(X1=panel_2, X2=normalize_2, X3=normalize)

objprops_2 = ObjectProperties(Object=item_2)  # -> Centroid, PCA1, PCA2, PCA3, Length, Width, Height, BoundingBox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

# ----
# OverridePCA:
# DigitalCircularityToolkit automatically
# finds the local coordinate system
# by fitting a plane to the "flattest"
# dimensions of the object.
# 
# If you want to force this local plane
# to be something else,
# use OverridePCA and a new plane
number_slider_7 = Slider(-0.3, range=-1..1)
# Define the new plane
# normal here
number_slider_8 = Slider(-0.3, range=-1..1)
vec = VectorXYZ(XComponent=number_slider_7, YComponent=Slider(-0.4, range=-1..1), ZComponent=number_slider_8)  # -> Vector, Length
pl_3 = PlaneNormal(Origin=objprops_2.Centroid, ZAxis=vec.Vector)
overridepca = OverridePCA(Object=item_2, PrincipalPlane=pl_3)

# ----
# Alternatively get the convex
# hull projected onto a principal axis
# (right click on Plane)
hull2d = PlanarHull(Object=item_3, Plane=3)  # -> Hull, Plane
previewlw_2 = CustomPreviewLineweights(Geometry=hull2d.Hull, Shader=ColourSwatch(SwatchColor=RGB(188, 54, 255)), Thickness=number_slider_5, Absolute=False)

planaroutline_2 = PlanarOutline(Object=overridepca)
# NOTE:
# The Hungarian algorithm only takes
# in integer values as a distance.
# 
# Cost must be greater than 1, and ideally
# greater than 100
panel_3 = Panel(featurevec)
previewlw_3 = CustomPreviewLineweights(
    Geometry=planaroutline_2,
    Shader=ColourSwatch(SwatchColor=RGB(0, 174, 255)),
    Thickness=Slider(3, range=1..5),
    Absolute=False)
