# Grasshopper definition Advanced_02_HarmonicAnalysis.gh (Grasshopper 1.0.7)
# plug-ins: DigitalCircularityToolkit, Human

# ----
# Harmonic Analysis is a powerful
# method of characterizing
# (for now, planar) shapes that is invariant
# to rotation or translation
# A subset of our rocks
# (DEMAND)
mesh = Mesh([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])
obj = Object(Geometry=mesh, NumSamples=50, ID="NoID")  # -> Object, Geometry
objprops = ObjectProperties(Object=obj.Object)  # -> Centroid, PCA1, PCA2, PCA3, Length, Width, Height, BoundingBox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
preview = CustomPreview(Geometry=objprops.Geometry, Material=ColourSwatch(SwatchColor=RGBA(255, 255, 255, 141)))

# ----
# Harmonic Analysis works for 2D curves
# Extract the planar outline
# (choose a custom plane if you want)
# 
# Or alternatively use the Planar Hull
planaroutline = PlanarOutline(Object=obj.Object)
number_slider = Slider(3, range=1..5)
swatch = ColourSwatch(SwatchColor=RGB(0, 153, 255))
previewlw = CustomPreviewLineweights(Geometry=planaroutline, Shader=swatch, Thickness=number_slider, Absolute=False)

# ----
# DistanceSignature measures the
# distance from the centroid to the
# intersection point
# 
# Below is the distance signature
# of all the input objects
# ComplexSignature measures the
# intersection as a complex number.
# If the intersection occurs at [u,v] in
# local plane coordinates, then it is
# converted to a complex number
# c = u + iv, where i = sqrt(-1)
# RadialSignature:
# Shoots a ray from the centroid of
# a curve, and captures the intersection point.
number_slider_2 = Slider(36, range=20..100)
# Hide the geometry in Rhino
# to get a better look at the rays
radialsig = RadialSignature(Curve=planaroutline, NumSamples=number_slider_2)  # -> ComplexSignature, DistanceSignature, ProjectedCurve, Rays
previewlw_2 = CustomPreviewLineweights(Geometry=radialsig.Rays, Shader=swatch, Thickness=number_slider, Absolute=False)
graph = QuickGraph(radialsig.DistanceSignature, SortOrder=0)

# ----
# The other set of rocks
# (SUPPLY)
mesh_2 = Mesh([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])
obj_2 = Object(Geometry=mesh_2, NumSamples=50, ID="NoID")  # -> Object, Geometry
planaroutline_2 = PlanarOutline(Object=obj_2.Object)
number_slider_3 = Slider(2, range=1..5)
swatch_2 = ColourSwatch(SwatchColor=RGB(0, 153, 255))
previewlw_3 = CustomPreviewLineweights(Geometry=planaroutline_2, Shader=swatch_2, Thickness=number_slider_3, Absolute=False)
radialsig_2 = RadialSignature(Curve=planaroutline_2, NumSamples=number_slider_2)  # -> ComplexSignature, DistanceSignature, ProjectedCurve, Rays
previewlw_4 = CustomPreviewLineweights(Geometry=radialsig_2.Rays, Shader=swatch_2, Thickness=number_slider_3, Absolute=False)
graph_2 = QuickGraph(radialsig_2.DistanceSignature, SortOrder=0)

objprops_2 = ObjectProperties(Object=obj_2.Object)  # -> Centroid, PCA1, PCA2, PCA3, Length, Width, Height, BoundingBox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
preview_2 = CustomPreview(Geometry=objprops_2.Geometry, Material=ColourSwatch(SwatchColor=RGBA(255, 255, 255, 166)))

# ----
# HarmonicsComplex
# Analyze the ComplexSignature
# HarmonicsReal
# Analyze the DistanceSignature
# Directly comparing two signatures
# won't be particularly useful, since
# the signature depends on the order
# of sampling
# 
# HarmonicAnalysis resolves this issue,
# and measures the signature in Frequency Space
# using Fourier Transforms
harmonicscomplex = HarmonicAnalysisComplex(ComplexSig=radialsig_2.ComplexSignature)
harmonicscomplex_2 = HarmonicAnalysisComplex(ComplexSig=radialsig.ComplexSignature)
harmonicsreal = HarmonicAnalysisReal(Signature=radialsig_2.DistanceSignature)
harmonicsreal_2 = HarmonicAnalysisReal(Signature=radialsig.DistanceSignature)
graph_3 = QuickGraph(harmonicscomplex_2, SortOrder=0)
graph_4 = QuickGraph(harmonicsreal_2, SortOrder=0)
graph_5 = QuickGraph(harmonicscomplex, SortOrder=0)
graph_6 = QuickGraph(harmonicsreal, SortOrder=0)

# ----
# The output of harmonic analysis
# can be directly used as
# Feature Vectors
# Try using the output of HarmonicsReal
# instead and evaluate the quality of
# matching results
dmeuclidean = EuclideanDistance(FVdemand=harmonicscomplex_2, FVsupply=harmonicscomplex, Power=1)
hungarian = Hungarian(DistanceMatrix=dmeuclidean)  # -> Assignment, Cost

item = ListItem(List=obj_2.Object, Index=hungarian.Assignment, Wrap=True)
alignobj = AlignToObject(SourceObject=item, TargetObject=obj.Object)  # -> Object, Geometry, Transform
matchlines = MatchLines(DemandPoints=objprops.Centroid, SupplyPoints=objprops_2.Centroid, AssignmentIndices=hungarian.Assignment)
preview_3 = CustomPreview(Geometry=alignobj.Geometry, Material=ColourSwatch(SwatchColor=RGBA(0, 162, 255, 194)))
