# Grasshopper definition Advanced_03_QuantitiesAndEffectiveGeometry.gh (Grasshopper 1.0.7)
# plug-ins: DigitalCircularityToolkit, Human

# ----
# Adjust quantity here
# Sometimes our inventory
# isn't that irregular. We can define multiple
# quantities of an abstracted object to
# reflect stock, while improving
# computational speed
# We can also set geometric buffers
# using factors.
# 
# For LinearObjects, we can set a
# length buffer, fL, that makes the
# effective length:
# 
# fL * Lactual
# 
# This is useful if we know we need to
# overlap the ends of our members
# to make connections, so the
# "free" length is shorter
# Similar factors exist for
# planar, box, and spherical objects
brep = Brep(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)
brep_2 = Brep(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)
brep_3 = Brep(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)
brep_4 = Brep(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)
brep_5 = Brep(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)
swatch = ColourSwatch(SwatchColor=RGBA(230, 96, 96, 160))
swatch_2 = ColourSwatch(SwatchColor=RGBA(96, 230, 161, 160))
swatch_3 = ColourSwatch(SwatchColor=RGBA(212, 96, 230, 160))
swatch_4 = ColourSwatch(SwatchColor=RGBA(210, 230, 96, 160))
swatch_5 = ColourSwatch(SwatchColor=RGBA(96, 112, 230, 158))
preview = CustomPreview(Geometry=brep_5, Material=swatch)
preview_2 = CustomPreview(Geometry=brep_2, Material=swatch_2)
preview_3 = CustomPreview(Geometry=brep, Material=swatch_3)
preview_4 = CustomPreview(Geometry=brep_4, Material=swatch_4)
preview_5 = CustomPreview(Geometry=brep_3, Material=swatch_5)
lineobj = LinearObject(
    Geometry=brep_5,
    NumSamples=50,
    Quantity=Slider(13, range=0..100),
    LengthBuffer=Slider(0.9, range=0.75..1),
    Area=-1,
    ID="NoID")  # -> Object, EffectiveLine
lineobj_2 = LinearObject(Geometry=brep_4, NumSamples=50, Quantity=Slider(19, range=0..100), LengthBuffer=1, Area=-1, ID="NoID")  # -> Object, EffectiveLine
lineobj_3 = LinearObject(Geometry=brep, NumSamples=50, Quantity=Slider(11, range=0..100), LengthBuffer=1, Area=-1, ID="NoID")  # -> Object, EffectiveLine
lineobj_4 = LinearObject(Geometry=brep_3, NumSamples=50, Quantity=Slider(28, range=0..100), LengthBuffer=1, Area=-1, ID="NoID")  # -> Object, EffectiveLine
lineobj_5 = LinearObject(Geometry=brep_2, NumSamples=50, Quantity=Slider(10, range=0..100), LengthBuffer=1, Area=-1, ID="NoID")  # -> Object, EffectiveLine
merge = Merge(Data1=lineobj_5.Object, Data2=lineobj_4.Object, Data3=lineobj_3.Object, Data4=lineobj_2.Object, Data5=lineobj.Object)

merge_2 = Merge(Data1=swatch_2, Data2=swatch_5, Data3=swatch_3, Data4=swatch_4, Data5=swatch)

# ----
# Notice that from 5 geometries,
# our inventory has 81 elements
# Inds keeps track of the
# *actual* object used during assignment.
# 
# If we assign inventory item i = 50 to
# a design, we are actually assigning
# object Inds[i] = X
# 
# You will see when this becomes useful
linearset = LinearSet(LinearObjs=merge)  # -> EffectiveLine, EffectiveLength, Area, CentroidPlane, Indexer, Objects, Centroids, Hulls, IDs
lng = ListLength(List=linearset.EffectiveLine)
panel = Panel(linearset.Indexer)
panel_2 = Panel(lng)
featurevec = FeatureVector(X1=linearset.EffectiveLength)

# ----
# Start drawing lines on the
# "Design" layer in Rhino!
# We'll use a 1D feature vector of length L
# If we perform structural analysis,
# we can make a 2D feature vector
# that includes the required Area
pipeline = GeometryPipeline(
    GroupByLayer=False,
    GroupByType=False,
    IncludeHidden=True,
    IncludeLocked=True,
    LayerFilter="*Design",
    NameFilter="*",
    SublayerFiltering=True,
    TypeFilter=4)
lineobj_6 = LinearObject(Geometry=pipeline, NumSamples=50, Quantity=1, LengthBuffer=1, Area="1", ID="NoID")  # -> Object, EffectiveLine
linearset_2 = LinearSet(LinearObjs=lineobj_6.Object)  # -> EffectiveLine, EffectiveLength, Area, CentroidPlane, Indexer, Objects, Centroids, Hulls, IDs
featurevec_2 = FeatureVector(X1=linearset_2.EffectiveLength)

# ----
# Matching
dmeuclidean = EuclideanDistance(FVdemand=featurevec_2, FVsupply=featurevec, Power=1)
hungarian = Hungarian(DistanceMatrix=dmeuclidean)  # -> Assignment, Cost

# ----
# The assignment index is
# converted to the actual object
# index using Inds
# Which we can use to extract
# the actual object that was used
# And let's also extract
# the colour of the object
item = ListItem(List=linearset.Indexer, Index=hungarian.Assignment, Wrap=True)
item_2 = ListItem(List=merge_2, Index=item, Wrap=True)
item_3 = ListItem(List=merge, Index=item, Wrap=True)

alignobj = AlignToObject(SourceObject=item_3, TargetObject=lineobj_6.Object)  # -> Object, Geometry, Transform
matchlines = MatchLines(DemandPoints=linearset_2.Centroids, SupplyPoints=linearset.Centroids, AssignmentIndices=hungarian.Assignment)
preview_6 = CustomPreview(Geometry=alignobj.Geometry, Material=item_2)

previewlw = CustomPreviewLineweights(Geometry=matchlines, Shader=ColourSwatch(SwatchColor=RGBA(219, 219, 219, 135)), Absolute=False)
