# Grasshopper definition script.gh (Grasshopper 1.0.7)
# plug-ins: DigitalCircularityToolkit

# ----
# GEOMETRY
# Objects can be represented by
# meshes, breps, curves, and collections of points
# ROCKS
# LINEAR STICKS
# WIGGLY STICKS
# PLANAR CURVES
# POINTCLOUD
mesh = Mesh([<mesh referenced from the Rhino model> x65])
brep = Brep([<brep referenced from the Rhino model> x162])
brep_2 = Brep([<brep referenced from the Rhino model> x102])
crv = Curve([<curve referenced from the Rhino model> x34])
pt = Point([<point referenced from the Rhino model> x2480])

# ----
# Try replacing the input set of geometries
# Point collections must be converted using ToPointCloud
pointcloud = ToPointCloud(Points=pt)
# OBJECTS
# A generic design object can be
# created from valid geometry
obj = Object(Geometry=mesh, NumSamples=50)

# ----
# Approx. lengths
# Approx. widths
# Approx. depths
# <-- Toggle preview of these properties
# (highlight the component and press ctrl+Q)
objprops = ObjectProperties(Object=obj)  # -> Centroid, PCA1, PCA2, PCA3, Length, Width, Height, BoundingBox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
bar_graph = BarGraph(objprops.Length, BarColor=RGB(255, 0, 90))
bar_graph_2 = BarGraph(objprops.Width, BarColor=RGB(255, 0, 90))
bar_graph_3 = BarGraph(objprops.Height, BarColor=RGB(255, 0, 90))
box = Box(objprops.BoundingBox)
mesh_2 = Mesh(objprops.VolumeHull)
crv_2 = Curve(objprops.PlanarHull)

# ----
# FEATURE VECTOR
# Use properties of objects (or other values)
# to create a feature vector for an object
# The FV is a numeric representation of an object
# Zoom into the FeatureVec component
# to add a new dimension, and try
# connecting the 'H' output from ObjectProperties
featurevec = FeatureVector(X1=objprops.Length, X2=objprops.Width)
panel = Panel(featurevec)
