# Grasshopper definition Basics_02_Matching.gh (Grasshopper 1.0.7)
# plug-ins: DigitalCircularityToolkit

# Try drawing and manipulating lines
# on the "Design" layer of the Rhino file
# This will read all curves drawn on
# the "Design" layer in Rhino
pipeline = GeometryPipeline(
    GroupByLayer=False,
    GroupByType=False,
    IncludeHidden=True,
    IncludeLocked=True,
    LayerFilter="*Design",
    NameFilter="*",
    SublayerFiltering=True,
    TypeFilter=4)

# ----
# INVENTORY (SUPPLY)
brep = Brep([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])
obj = Object(Geometry=brep, NumSamples=50, ID="NoID")  # -> Object, Geometry
objprops = ObjectProperties(Object=obj.Object)  # -> Centroid, PCA1, PCA2, PCA3, Length, Width, Height, BoundingBox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

# ----
# DESIGN (DEMAND)
crv = Curve(pipeline)
obj_2 = Object(Geometry=crv, NumSamples=50, ID="NoID")  # -> Object, Geometry
objprops_2 = ObjectProperties(Object=obj_2.Object)  # -> Centroid, PCA1, PCA2, PCA3, Length, Width, Height, BoundingBox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

# ----
# We create a 1-dimensional
# feature vector
# of the length of our objects
featurevec = FeatureVector(X1=objprops_2.Length)
featurevec_2 = FeatureVector(X1=objprops.Length)

# ----
# If you want to penalize negative values
# (IE too short is worse than too long)
# we can penalize them asymmetrically
# with DMAsymm
# Replace the input to Hungarian
# and see what happens!
dmasymm = AsymmEuclideanDistance(FVdemand=featurevec, FVsupply=featurevec_2, Power1=1, Power2=2)

# ----
# Create a Distance Matrix (DM)
# In this case, the difference in length
# between each demand to
# each supply
dmeuclidean = EuclideanDistance(FVdemand=featurevec, FVsupply=featurevec_2, Power=1)

# ----
# Hungarian takes in a DM
# and returns a list of indices in A
# Where for demand i, the optimal
# assignment is supply j = A[i]
hungarian = Hungarian(DistanceMatrix=dmeuclidean)  # -> Assignment, Cost

pt = Point(<point referenced from the Rhino model>)
format = Format(Format=hungarian.Cost, Culture=127)
concat = Concatenate(FragmentA="Assignment Cost: ", FragmentB=format)
tag = TextTag3D(Location=pt, Text=concat, Size=Slider(1409, range=1000..3000), Justification=7)

# ----
# AlignToObject
# This overlays the assigned object
# to the target design
# This pulls out the objects
# in the inventory used for assignment
item = ListItem(List=obj.Object, Index=hungarian.Assignment, Wrap=True)
alignobj = AlignToObject(SourceObject=item, TargetObject=obj_2.Object)  # -> Object, Geometry, Transform

# ----
# MatchLines
# This draws a line between
# designed objects and
# assigned inventory objects
# 
# pDemand and pSupply are points that
# represent each object.
# Generally use the Centroid point from
# DesignProperties
matchlines = MatchLines(DemandPoints=objprops_2.Centroid, SupplyPoints=objprops.Centroid, AssignmentIndices=hungarian.Assignment)
