# Grasshopper definition Basics_03_LinearObjects.gh (Grasshopper 1.0.7)
# plug-ins: DigitalCircularityToolkit

# SUPPLY
brep = Brep([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])
# Sometimes we know we want to
# abstract our objects as something
# more primitive, like a line
#  e.g., you want to make trusses.
# 
# Instead of making an Object, make a
# LinearObject
# DEMAND
brep_2 = Brep([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])

# ----
# LinearObjects finds the
# most representative line
# to represent your object
lineobj = LinearObject(Geometry=brep, NumSamples=50, Quantity=1, LengthBuffer=1, Area=-1, ID="NoID")  # -> Object, EffectiveLine
lineobj_2 = LinearObject(Geometry=brep_2, NumSamples=50, Quantity=1, LengthBuffer=1, Area=-1, ID="NoID")  # -> Object, EffectiveLine

# ----
# LinearSet
# Takes a collection of LinearObjects
# and outputs useful linear properties.
# This acts as a more tailored
# ObjectProperties component
linearset = LinearSet(LinearObjs=lineobj.Object)  # -> EffectiveLine, EffectiveLength, Area, CentroidPlane, Indexer, Objects, Centroids, Hulls, IDs
linearset_2 = LinearSet(LinearObjs=lineobj_2.Object)  # -> EffectiveLine, EffectiveLength, Area, CentroidPlane, Indexer, Objects, Centroids, Hulls, IDs

# ----
# Note that you can still
# use ObjectProperties with
# LinearObjects
objprops = ObjectProperties(Object=lineobj.Object)  # -> Centroid, PCA1, PCA2, PCA3, Length, Width, Height, BoundingBox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

number_slider = Slider(5000, range=0..100000)

# ----
# LineScore
# Measures how well a line
# actually abstracts the object
# 
# 0: a perfect line
# F: a horrible line
# 
# Change the upper bound with F,
# but cannot be less than 100
linescore = LineScore(Object=lineobj.Object, Factor=number_slider)
linescore_2 = LineScore(Object=lineobj_2.Object, Factor=number_slider)

# ----
# This time, we'll make a
# 3-dimensional FV, composed of:
# [Length, Area, LineScore]
# We adjusted F so that
# the magnitude of LineScore
# is similar to that of L and A
featurevec = FeatureVector(X1=linearset.EffectiveLength, X2=linearset.Area, X3=linescore)
featurevec_2 = FeatureVector(X1=linearset_2.EffectiveLength, X2=linearset_2.Area, X3=linescore_2)

# ----
# Create Distance Matrix and
# perform the Hungarian Algorithm
dmeuclidean = EuclideanDistance(FVdemand=featurevec_2, FVsupply=featurevec, Power=1)
hungarian = Hungarian(DistanceMatrix=dmeuclidean)  # -> Assignment, Cost

item = ListItem(List=linearset.Objects, Index=hungarian.Assignment, Wrap=True)
alignobj = AlignToObject(SourceObject=item, TargetObject=linearset_2.Objects)  # -> Object, Geometry, Transform
matchlines = MatchLines(DemandPoints=linearset_2.Centroids, SupplyPoints=objprops.Centroid, AssignmentIndices=hungarian.Assignment)
