# Grasshopper definition Basics_04_PlanarObjects.gh (Grasshopper 1.0.7)
# plug-ins: DigitalCircularityToolkit

# ----
# Squiggly curves
# PlanarObject
# Abstracts a given object as a plane.
# For 3D objects, a best fit plane is
# automatically calculated.
# Rocks
crv = Curve([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])
mesh = Mesh([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])

planeobj = PlanarObject(Geometry=crv, NumSamples=50, Quantity=1, LengthBuffer=1, WidthBuffer=1, Thickness=-1, ID="NoID")  # -> Object, EffectivePlane
planeobj_2 = PlanarObject(Geometry=mesh, NumSamples=50, Quantity=1, LengthBuffer=1, WidthBuffer=1, Thickness=-1, ID="NoID")  # -> Object, EffectivePlane
planarset = PlanarSet(PlanarObjs=planeobj.Object)  # -> EffectivePlane, Plane, EffectiveLength, EffectiveWidth, Thickness, Indexer, Objects, Centroids, Hulls, IDs
planarset_2 = PlanarSet(PlanarObjs=planeobj_2.Object)  # -> EffectivePlane, Plane, EffectiveLength, EffectiveWidth, Thickness, Indexer, Objects, Centroids, Hulls, IDs

# ----
# The planar Hull is the
# convex shadow of the object
# on the given plane.
# It's a fast "smooth" approximation
# of a planar object
# You can also see that the
# more irregular a shape is
# the worse the hull abstraction
crv_2 = Curve(planarset_2.Hulls)
crv_3 = Curve(planarset.Hulls)

# ----
# PlaneScore
# Measures how flat an object is.
# 
# 0: Perfect planar abstraction
# F: Bad planar abstraction
planescore = PlaneScore(Object=planeobj_2.Object, Factor=100)
planescore_2 = PlaneScore(Object=planeobj.Object, Factor=100)
graph = QuickGraph(planescore_2, SortOrder=0)
graph_2 = QuickGraph(planescore, SortOrder=0)

# ----
# Make a 2D feature vector of:
# -Aspect ratio of plane "L/W"
# -Plane score
division = Division(A=planarset_2.EffectiveLength, B=planarset_2.EffectiveWidth)
division_2 = Division(A=planarset.EffectiveLength, B=planarset.EffectiveWidth)
featurevec = FeatureVector(X1=division_2, X2=planescore_2)
featurevec_2 = FeatureVector(X1=division, X2=planescore)

# ----
# Match
dmeuclidean = EuclideanDistance(FVdemand=featurevec, FVsupply=featurevec_2, Power=1)
hungarian = Hungarian(DistanceMatrix=dmeuclidean)  # -> Assignment, Cost

# ----
# Visualize
# The results are not that great...
# Try making a new 3D feature vector
# that explicitly takes in the plane
# dimensions:
# 
# - L
# - W
# - PlaneScore
item = ListItem(List=planarset_2.Objects, Index=hungarian.Assignment, Wrap=True)
matchlines = MatchLines(DemandPoints=planarset.Centroids, SupplyPoints=planarset_2.Centroids, AssignmentIndices=hungarian.Assignment)
alignobj = AlignToObject(SourceObject=item, TargetObject=planarset.Objects)  # -> Object, Geometry, Transform
