# Grasshopper definition script.gh (Grasshopper 1.0.7)
# plug-ins: DigitalCircularityToolkit

# ----
# Squiggly sticks
# Rocks
brep = Brep([<brep referenced from the Rhino model> x102])
mesh = Mesh([<mesh referenced from the Rhino model> x65])

# ----
# SphericalObject
# 
# Abstracts object as a sphere
sphereobj = SphericalObject(NumSamples=50, Quantity=1, RadiusBuffer=1)  # -> Object, EffectiveSphere
sphereobj_2 = SphericalObject(NumSamples=50, Quantity=1, RadiusBuffer=1)  # -> Object, EffectiveSphere
sphereset = SphereSet(SphereObjs=sphereobj.Object)  # -> EffectiveSphere, Plane, EffectiveRadius, Indexer, Objects, Centroids, Hulls
sphereset_2 = SphereSet(SphereObjs=sphereobj_2.Object)  # -> EffectiveSphere, Plane, EffectiveRadius, Indexer, Objects, Centroids, Hulls

# ----
# BoxObject
# 
# Abstracts object as a box
boxobj = BoxObject(Geometry=mesh, NumSamples=50, Quantity=1, LengthBuffer=1, WidthBuffer=1, HeightBuffer=1)  # -> Object, EffectiveBox
boxobj_2 = BoxObject(Geometry=brep, NumSamples=50, Quantity=1, LengthBuffer=1, WidthBuffer=1, HeightBuffer=1)  # -> Object, EffectiveBox
boxset = BoxSet(Objects=boxobj_2.Object)  # -> EffectiveBox, Plane, EffectiveLength, EffectiveWidth, EffectiveHeight, Indexer, Objects, Centroids, Hulls
boxset_2 = BoxSet(Objects=boxobj.Object)  # -> EffectiveBox, Plane, EffectiveLength, EffectiveWidth, EffectiveHeight, Indexer, Objects, Centroids, Hulls

# ----
# SphereScore
# Measures how well
# a sphere abstracts the object:
# 
# -0: perfect sphere
# -F: terrible sphere
spherescore = SphereScore(SphericalObject=sphereset_2.Objects, Factor=100)
spherescore_2 = SphereScore(SphericalObject=sphereset.Objects, Factor=100)
graph = QuickGraph(spherescore_2, SortOrder=0)
graph_2 = QuickGraph(spherescore, SortOrder=0)
avr = Average(Input=spherescore)
avr_2 = Average(Input=spherescore_2)
format = Format(Format=avr, Culture=127)
format_2 = Format(Format=avr_2, Culture=127)
pt = Point(<point referenced from the Rhino model>)
pt_2 = Point(<point referenced from the Rhino model>)
concat = Concatenate(FragmentA="Average score: ", FragmentB=format)
concat_2 = Concatenate(FragmentA="Average score: ", FragmentB=format_2)
panel = Panel("2000")
tag = TextTag3D(Location=pt, Text=concat, Size="2000", Justification=7)
tag_2 = TextTag3D(Location=pt_2, Text=concat_2, Size="2000", Justification=7)

# ----
# BoxScore
# Measures how well
# a box abstracts the object:
# 
# -0: perfect box
# -F: terrible box
boxscore = BoxScore(BoxObject=boxset.Objects, Factor=100)
# How well do boxes and spheres
# abstract these two sets?
# 
# Try evaluating the SphereScore
# by connecting the geometry
# to SphereObject below
boxscore_2 = BoxScore(BoxObject=boxset_2.Objects, Factor=100)
graph_3 = QuickGraph(boxscore, SortOrder=0)
graph_4 = QuickGraph(boxscore_2, SortOrder=0)
avr_3 = Average(Input=boxscore_2)
avr_4 = Average(Input=boxscore)
format_3 = Format(Format=avr_3, Culture=127)
format_4 = Format(Format=avr_4, Culture=127)
pt_3 = Point(<point referenced from the Rhino model>)
pt_4 = Point(<point referenced from the Rhino model>)
concat_3 = Concatenate(FragmentA="Average score: ", FragmentB=format_3)
concat_4 = Concatenate(FragmentA="Average score: ", FragmentB=format_4)
tag_3 = TextTag3D(Location=pt_3, Text=concat_3, Size="2000", Justification=7)
tag_4 = TextTag3D(Location=pt_4, Text=concat_4, Size="2000", Justification=7)
